# Grasshopper definition Experimental structure - arc bridge.gh (Grasshopper 1.0.8)
# plug-ins: Karamba3D

degree_of_bow_chord_arc = Slider(60, range=0..180)
depth_of_bow_chord = Slider(-5, range=-25..25)
point = Point(Point(0, 0, 0))
number = Number(25)
division = Slider(12, range=2..20)
pt = ConstructPoint(XCoordinate=number, YCoordinate=0, ZCoordinate=0)
Z = UnitZ(Factor=depth_of_bow_chord)
move = Move(Geometry=[point, pt], Motion=Z)  # -> Geometry, Transform
ln = Line(StartPoint=point, EndPoint=pt)
point_2 = Point([point, pt, move.Geometry])
Z_2 = UnitZ(Factor=1)
Y = UnitY(Factor=1)
rad = Radians(Degrees=degree_of_bow_chord_arc)
Z_3 = UnitZ(Factor=Slider(-10, range=-1000..0))
vrot = Rotate(Vector=Z_2, Axis=Y, Angle=rad)
split = SplitList(List=move.Geometry, Index="1")  # -> ListA, ListB
support_karamba3d = Supp(PosInd=point_2, menu=[buttons(on, on, on, on, on, on)])
divide = DivideCurve(Curve=ln, Count=division, Kinks=False)  # -> flatten(Points), Tangents, Parameters
loads_karamba3d = Loads(Vector=Vector(0, 0, -1), LCase="LC0", mode="Gravity")
loads_karamba3d_2 = Loads(ForceVector=Z_3, Local=False, PosInd=divide.Points, LCase="LC0", mode="Point")
arc = ArcSED(Start=split.ListA, End=split.ListB, Direction=vrot)  # -> Arc, Plane, Radius
Z_4 = UnitZ(Factor=Slider(-5, range=-10..0))
divide_2 = DivideCurve(Curve=arc.Arc, Count=division, Kinks=False)  # -> flatten(Points), Tangents, Parameters
panel = Panel("""0
-1""")
panel_2 = Panel("""0
-1""")
cull_i = CullIndex(List=divide.Points, Indices=panel_2, Wrap=True)
cull_i_2 = CullIndex(List=divide_2.Points, Indices=panel, Wrap=True)
difference = SetDifference(SetA=divide_2.Points, SetB=cull_i_2)
difference_2 = SetDifference(SetA=divide.Points, SetB=cull_i)
lng = ListLength(List=cull_i)
lng_2 = ListLength(List=divide_2.Points)
lng_3 = ListLength(List=cull_i_2)
lng_4 = ListLength(List=divide_2.Points)
int = Integer(0)
int_2 = Integer(0)
int_3 = Integer(0)
int_4 = Integer(0)
series = Series(Start=int, Step=1, Count=expr("(x+1)/2", lng))
series_2 = Series(Start=int_2, Step=1, Count=expr("(x-1)/2", lng_2))
series_3 = Series(Start=int_3, Step=1, Count=expr("(x+1)/2", lng_3))
series_4 = Series(Start=int_4, Step=1, Count=expr("(x-1)/2", lng_4))
rev = ReverseList(List=cull_i)
rev_2 = ReverseList(List=divide_2.Points)
item = ListItem(List=cull_i, Index=series, Wrap=True)
item_2 = ListItem(List=divide_2.Points, Index=series_2, Wrap=True)
item_3 = ListItem(List=rev, Index=series_3, Wrap=True)
item_4 = ListItem(List=rev_2, Index=series_4, Wrap=True)
pline = PolyLine(Vertices=divide.Points, Closed=False)
pline_2 = PolyLine(Vertices=divide_2.Points, Closed=False)
activate = BooleanToggle(False)
activate_2 = BooleanToggle(False)
explode = Explode(Curve=pline, Recursive=True)  # -> flatten(Segments), Vertices
ln_2 = Line(StartPoint=divide.Points, EndPoint=divide_2.Points)
explode_2 = Explode(Curve=pline_2, Recursive=True)  # -> flatten(Segments), Vertices
ln_3 = Line(StartPoint=item, EndPoint=item_2)
ln_4 = Line(StartPoint=item_3, EndPoint=item_4)
line = Line(flatten([explode.Segments, ln_2, ln_3, ln_4, explode_2.Segments]))
curve_middle = CurveMiddle(Curve=line)
deconstruct_vector = DeconstructVector(Vector=curve_middle)  # -> XComponent, YComponent, ZComponent
equality = Equality(FirstNumber=deconstruct_vector.ZComponent, SecondNumber="0")  # -> Equality, Inequality
material_selection_karamba3d = MatSelect(menu=[dropdown(1), dropdown(4)])
remove_duplicate_lines_karamba3d = RDLines(Line=line, LimitDistance="0.00001")  # -> OutLine, Info, Indexes
cross_section_karamba3d = CroSec(
    FamilyNameOfCrossSection="DefaultCroSec",
    NameOfCrossSection="O-Sec",
    Material=material_selection_karamba3d,
    Diameter_cm=Slider(40, range=0..100),
    WallThickness_cm=Slider(4, range=0..50),
    mode="Circular Hollow")
create_linear_element_karamba3d = LineElem(
    Line=remove_duplicate_lines_karamba3d.OutLine,
    CrossSection=cross_section_karamba3d,
    LimitDistance_m=0.005,
    BucklingLengthY_m=-1,
    BucklingLengthZ_m=-1,
    BucklingLengthLT_m=-1,
    Bending=True,
    ToPolylineMaxAngle=0.03,
    ToPolylineTolerance=0.01,
    ToPolylineMaxEdgeLength=0.25,
    New=True,
    Remove=True,
    mode="LineToBeam")  # -> Element, Points, Info
cull_pattern = CullPattern(List=create_linear_element_karamba3d.Element, CullPattern=equality.Equality)
beam_loads_karamba3d = BeamLoads(
    BeamIdentifier=cull_pattern,
    LoadCase="LC0",
    ForceVector=Z_4,
    TPosition=flatten(["0", "1"]),
    mode="Concentrated",
    menu=[buttons(off, on)])  # -> flatten(Load)
assemble_model_karamba3d = Assemble(
    Elem=create_linear_element_karamba3d.Element,
    Support=support_karamba3d,
    Load=[loads_karamba3d, beam_loads_karamba3d],
    LimitDistance_m=0.005)  # -> Model, Info, Mass_kg, CentreOfGravity, LoadCaseNames
model_karamba3d = ModelKaramba3D(flatten(assemble_model_karamba3d.Model))
model_karamba3d_2 = ModelKaramba3D(flatten(assemble_model_karamba3d.Model))
model_karamba3d_3 = ModelKaramba3D(flatten(assemble_model_karamba3d.Model))
python_3_script = Python3Script(Model_in=model_karamba3d_2, element_sequence="[0, 9, 3, 0, 3, 15, 5, 13, 7, 1, 14, 6, 9, 12, 0, 12, 14]")  # -> out, feasible; disabled
# ---------- python_3_script: Python ----------
import Rhino.Geometry
from Grasshopper.Kernel.Data import GH_Path
from Grasshopper import DataTree
import json
from collections import defaultdict
import ast

model = Model_in.Clone()
model.cloneElements()

element_from_id = {e.ind: tuple(e.node_inds) for e in model.elems}
ground_nodes = {s.node_ind for s in model.supports}

active_nodes = set(ground_nodes)
active_elements = set()

feasible = True

element_sequence = ast.literal_eval(element_sequence)
for elem in element_sequence:
    node1, node2 = element_from_id[elem]
    
    if node1 not in active_nodes and node2 not in active_nodes:
        print(f"element{elem} (node{node1} and node{node2}) cannot connect existing structure!")
        feasible = False
        break
    else:
        active_elements.add(elem)
        active_nodes.add(node1)
        active_nodes.add(node2)

if feasible:
    print("The sequence is feasible")
# ---------- end python_3_script ----------
python_3_script_2 = Python3Script(activate=activate, Model_in=model_karamba3d, CroSecs_in=cross_section_karamba3d)  # -> out, max_disps, max_stresses, is_active, test
# ---------- python_3_script_2: Python ----------
import clr
import math

import Karamba.Models
import Karamba.CrossSections
import Karamba.Elements
import Karamba.Results
from Karamba.Geometry import *
from System.Collections.Generic import List
from System import String
from Karamba.Algorithms import Analyze
from Grasshopper.Kernel.Data import GH_Path
from Grasshopper import DataTree
import System
from System import Guid
import Grasshopper
from Karamba.Results import Utilization_Beam, BeamResultantForces

if activate and Model_in is not None:
    all_elements = [elem.ind for elem in Model_in.elems]
    disps = []
    stresses = []

    for i in range(17):
        current_active_ele_ids = all_elements[: i + 1]

        fea_model = Model_in.Clone()
        fea_model.cloneElements()

        for ele in fea_model.elems:
            ele.set_is_active(fea_model, ele.ind in current_active_ele_ids)

        loadCases = ["LC0"]
        max_disp, resultant_force, elastic_energy, out_model, warning = Analyze.solve(
            fea_model, loadCases
        )

        loadCaseName = loadCases[0]
        
        max_stress = 0.0

        for elem_ind in current_active_ele_ids:
            beam = out_model.elems[elem_ind]
            if not isinstance(beam, Karamba.Elements.ModelBeam):
                continue

            # avoid side effects
            beam = beam.Clone()
            out_model.elems[elem_ind] = beam

            elemId = List[String](str(elem_ind))
            N, V, M = BeamResultantForces.solve(out_model, elemId, loadCaseName, 10, 5)

            crosec = CroSecs_in
            beam.crosec = crosec
            maxSigma = abs(N[0][0]) / crosec.A + M[0][0] / crosec.Wely_z_pos;

            # stresses.append(float(maxSigma))
            if maxSigma > max_stress:
                max_stress = maxSigma

        stresses.append(float(max_stress))

    test = stresses
# ---------- end python_3_script_2 ----------
python_3_script_3 = Python3Script(activate=activate_2, Model_in=model_karamba3d_3)  # -> out, max_disps, max_stresses, is_active, test
# ---------- python_3_script_3: Python ----------
import clr
import math

import Karamba.Models
import Karamba.CrossSections
import Karamba.Elements
import Karamba.Results
from Karamba.Geometry import *
from System.Collections.Generic import List
from System import String
from Karamba.Algorithms import Analyze
from Grasshopper.Kernel.Data import GH_Path
from Grasshopper import DataTree
import System
from System import Guid
import Grasshopper
from Karamba.Results import Utilization_Beam, BeamResultantForces

if activate and Model_in is not None:
    all_elements = [elem.ind for elem in Model_in.elems]
    disps = []

    for i in range(17):
        current_active_ele_ids = all_elements[: i + 1]

        fea_model = Model_in.Clone()
        fea_model.cloneElements()

        for ele in fea_model.elems:
            ele.set_is_active(fea_model, ele.ind in current_active_ele_ids)

        loadCases = ["LC0"]
        max_disp, resultant_force, elastic_energy, out_model, warning = Analyze.solve(
            fea_model, loadCases
        )

        for d in max_disp:
            disp_values = float(d)
        disps.append(disp_values)

    max_disps = sum(disps)
    test = disps
# ---------- end python_3_script_3 ----------
panel_3 = Panel(python_3_script.out)
panel_4 = Panel(python_3_script.feasible)
quick_graph = QuickGraph(python_3_script_2.test, SortOrder=0)
panel_5 = Panel(python_3_script_2.test)
quick_graph_2 = QuickGraph(python_3_script_3.test, SortOrder=0)
panel_6 = Panel(python_3_script_3.test)
analyse_karamba3d = Analyse(Model=assemble_model_karamba3d.Model)  # -> AnalysedModel, MaximumDisplacement_cm, ResultingForce_kN, ChangeOfElasticEnergy_kNm; disabled
objective = ValueList({"displacement", "stress"}, selected="displacement")
objective_2 = ValueList({"displacement", "stress"}, selected="displacement")
objective_3 = ValueList({"displacement", "stress"}, selected="stress")
model_view_karamba3d = ModelView(Model=analyse_karamba3d.AnalysedModel)  # -> Model, DeformedMesh, DeformedAxes, DeformedModel, MaximumDeformation
objective_4 = ValueList({"displacement", "stress"}, selected="displacement")
min_stress = Panel("[12, 25, 36, 24, 43, 37, 11, 23, 35, 44, 0, 13, 26, 10, 38, 22, 1, 34, 45, 14, 39, 2, 15, 9, 21, 33, 27, 28, 40, 3, 16, 29, 41, 17, 46, 4, 8, 20, 32, 47, 7, 19, 30, 48, 18, 42, 5, 31, 6]")
min_disp = Panel("[11, 36, 12, 23, 0, 25, 13, 35, 24, 26, 43, 37, 1, 10, 14, 38, 27, 22, 44, 2, 15, 34, 39, 40, 9, 21, 45, 3, 46, 8, 16, 20, 33, 28, 41, 32, 29, 47, 4, 17, 30, 31, 18, 6, 19, 7, 5, 48, 42]")
panel_7 = Panel("[0, 1, 2, 3, 4, 5, 6, 7, 8, 9, 10, 11, 12, 13, 14, 15, 16, 17, 18, 19, 20, 21, 22, 23, 24, 25, 26, 27, 28, 29, 30, 31, 32, 33, 34, 35, 36, 37, 38, 39, 40, 41, 42, 43, 44, 45, 46, 47, 48]")
panel_8 = Panel("[11, 23, 44, 36, 22, 37, 34, 0, 13, 12, 25, 10, 9, 21, 46, 8, 24, 43, 33, 45, 1, 14, 35, 47, 20, 7, 38, 6, 2, 48, 32, 15, 31, 42, 18, 17, 41, 26, 30, 3, 16, 29, 28, 27, 19, 40, 4, 39, 5]")
activate_3 = BooleanToggle(False)
objective_5 = ValueList({"displacement", "stress"}, selected="displacement")
objective_6 = ValueList({"displacement", "stress"}, selected="stress")
activate_4 = BooleanToggle(False)
activate_5 = BooleanToggle(False)
list_length = ListLength(List=create_linear_element_karamba3d.Element)
activate_6 = BooleanToggle(False)
python_3_script_4 = Python3Script(activate=activate_3, Model_in=assemble_model_karamba3d.Model, objective=objective, CroSecs_in=cross_section_karamba3d)  # -> out, Model_out, flatten(opt_seq), flatten(fitness_history)
# ---------- python_3_script_4: Python ----------
import math
import random
import pygad
from collections import defaultdict
import numpy as np

# Karamba imports
import Karamba.Models
import Karamba.Elements
import Karamba.Results
from System.Collections.Generic import List
from System import String
from Karamba.Algorithms import Analyze
from Karamba.Results import BeamResultantForces, NodeDisplacements

# Global variables
cached_results = defaultdict(float)
cache_hits = 0
cache_misses = 0
current_best_fitness = float('-inf')

def check_sequence_feasibility(model, sequence):
    """Check if a construction sequence is feasible."""
    try:
        element_from_id = {e.ind: tuple(e.node_inds) for e in model.elems}
        ground_nodes = {s.node_ind for s in model.supports}
        active_nodes, active_elements = set(ground_nodes), set()
        
        for elem in sequence:
            node1, node2 = element_from_id[elem]
            if node1 not in active_nodes and node2 not in active_nodes:
                return False
            active_elements.add(elem)
            active_nodes.add(node1)
            active_nodes.add(node2)
        return True
    except Exception as e:
        print(f"Feasibility check error: {e}")
        return False

def evaluate_sequence(model, sequence, objective="displacement", CroSecs_in=None):
    """Evaluate a construction sequence with caching and early termination."""
    global cache_hits, cache_misses, current_best_fitness
    
    if not check_sequence_feasibility(model, sequence):
        return float("inf")
    
    fea_model = model.Clone()
    fea_model.cloneElements()
    load_cases = ["LC0"]
    max_value = 0.0
    
    if objective == "displacement":
        disps = []
        active_nodes = set()
        element_node_map = {e.ind: set(e.node_inds) for e in fea_model.elems}
        
        for i, elem_ind in enumerate(sequence):
            active_nodes.update(element_node_map[elem_ind])
            sub_seq = tuple(sequence[:i + 1])
            sub_key = (sub_seq, objective)
            
            if sub_key in cached_results:
                cache_hits += 1
                current_disp = cached_results[sub_key]
            else:
                cache_misses += 1
                for ele in fea_model.elems:
                    ele.set_is_active(fea_model, ele.ind in sub_seq)
                
                _, _, _, out_model, _ = Analyze.solve(fea_model, load_cases)
                node_indices = List[int](active_nodes)
                trans, _, _, _, _ = NodeDisplacements.solve(out_model, load_cases[0], node_indices)
                
                max_disp = max(math.sqrt(t.X**2 + t.Y**2 + t.Z**2) for nt in trans for t in nt)
                current_disp = max_disp * 1000  # Convert to mm
                cached_results[sub_key] = current_disp
            
            disps.append(current_disp)
            max_value = max(disps)
            
            if -max_value < current_best_fitness:
                return max_value
                
        return max_value
        
    elif objective == "stress":
        if CroSecs_in is None:
            raise ValueError("Cross-section (CroSecs_in) must be provided for stress objective!")
            
        stresses = []
        for i, elem_ind in enumerate(sequence):
            sub_seq = tuple(sequence[:i + 1])
            sub_key = (sub_seq, objective)
            
            if sub_key in cached_results:
                cache_hits += 1
                current_stress = cached_results[sub_key]
            else:
                cache_misses += 1
                for ele in fea_model.elems:
                    ele.set_is_active(fea_model, ele.ind in sub_seq)
                
                _, _, _, out_model, _ = Analyze.solve(fea_model, load_cases)
                max_stress = 0.0
                
                for elem_ind in sub_seq:
                    beam = out_model.elems[elem_ind]
                    if not isinstance(beam, Karamba.Elements.ModelBeam):
                        continue
                    
                    elem_id = List[String]([str(elem_ind)])
                    N, V, M = BeamResultantForces.solve(out_model, elem_id, load_cases[0], 1, 1)
                    axial_stress = abs(N[0][0]) / CroSecs_in.A
                    bending_stress = abs(M[0][0]) / CroSecs_in.Wely_z_pos
                    total_stress = (axial_stress + bending_stress) / 1e3  # Convert to MPa
                    max_stress = max(max_stress, total_stress)
                
                current_stress = max_stress
                cached_results[sub_key] = current_stress
            
            stresses.append(current_stress)
            max_value = max(stresses)
            
            if -max_value < current_best_fitness:
                return max_value
                
        return max_value
    
    raise ValueError(f"Unsupported objective: {objective}")

def fitness_func_max_disp(ga_instance, solution, solution_idx):
    """Fitness function for displacement minimization."""
    global current_best_fitness
    sequence = [int(all_elements[i]) for i in solution]
    fitness = -evaluate_sequence(Model_in, sequence, objective="displacement")
    current_best_fitness = max(current_best_fitness, fitness)
    return fitness

def fitness_func_max_stress(ga_instance, solution, solution_idx, CroSecs_in):
    """Fitness function for stress minimization."""
    global current_best_fitness
    sequence = [int(all_elements[i]) for i in solution]
    fitness = -evaluate_sequence(Model_in, sequence, objective="stress", CroSecs_in=CroSecs_in)
    current_best_fitness = max(current_best_fitness, fitness)
    return fitness

def compute_element_distances(model):
    """Compute minimum distance from each element to any support node."""
    element_from_id = {e.ind: tuple(e.node_inds) for e in model.elems}
    ground_nodes = {s.node_ind for s in model.supports}
    distances = {}
    
    for elem_id, (node1, node2) in element_from_id.items():
        pos1, pos2 = model.nodes[node1].pos, model.nodes[node2].pos
        min_dist = float('inf')
        for ground_node in ground_nodes:
            ground_pos = model.nodes[ground_node].pos
            dist1 = math.sqrt(sum((getattr(pos1, dim) - getattr(ground_pos, dim))**2 for dim in ('X', 'Y', 'Z')))
            dist2 = math.sqrt(sum((getattr(pos2, dim) - getattr(ground_pos, dim))**2 for dim in ('X', 'Y', 'Z')))
            min_dist = min(min_dist, dist1, dist2)
        distances[elem_id] = min_dist
    
    return distances

def generate_feasible_initial_solution(model, element_distances, randomness=0.4):
    """Generate a single feasible construction sequence prioritizing proximity to supports."""
    try:
        element_from_id = {e.ind: tuple(e.node_inds) for e in model.elems}
        ground_nodes = {s.node_ind for s in model.supports}
        active_nodes, remaining_elements = set(ground_nodes), set(element_from_id.keys())
        sequence = []
        
        while remaining_elements:
            feasible_elements = [e for e in remaining_elements 
                               if any(n in active_nodes for n in element_from_id[e])]
            if not feasible_elements:
                print("Warning: Construction sequence generation failed!")
                return None
            
            feasible_elements.sort(key=lambda e: element_distances[e])
            elem = (random.choice(feasible_elements[:max(3, len(feasible_elements)//2)])
                    if random.random() < randomness and len(feasible_elements) > 1
                    else feasible_elements[0])
            
            sequence.append(elem)
            active_nodes.update(element_from_id[elem])
            remaining_elements.remove(elem)
            
        return sequence if check_sequence_feasibility(model, sequence) else None
    except Exception as e:
        print(f"Initial solution error: {e}")
        return None

def generate_feasible_population(model, pop_size, all_elements):
    """Generate a population of feasible construction sequences."""
    population = []
    seen_sequences = set()
    element_distances = compute_element_distances(model)
    
    while len(population) < pop_size:
        feasible_seq = generate_feasible_initial_solution(model, element_distances, randomness=0.2)
        if feasible_seq:
            seq_tuple = tuple(feasible_seq)
            if seq_tuple not in seen_sequences:
                population.append([all_elements.index(e) for e in feasible_seq])
                seen_sequences.add(seq_tuple)
                
    return population

def initialize_with_feasible_population(ga_instance, model):
    """Initialize GA with feasible population."""
    pop = generate_feasible_population(model, ga_instance.sol_per_pop, all_elements)
    ga_instance.population = np.array(pop)
    print(f"Initialized population with {len(pop)} feasible solutions")

def feasible_crossover(parents, offspring_size, ga_instance):
    """Crossover operator maintaining feasibility."""
    offspring = []
    element_from_id = {e.ind: tuple(e.node_inds) for e in Model_in.elems}
    ground_nodes = {s.node_ind for s in Model_in.supports}
    
    for _ in range(offspring_size[0]):
        parent1, parent2 = parents[np.random.choice(len(parents), 2, replace=False)]
        seq1 = [all_elements[int(i)] for i in parent1]
        seq2 = [all_elements[int(i)] for i in parent2]
        
        point = random.randint(1, len(seq1) - 1)
        child = seq1[:point]
        active_nodes = set(ground_nodes).union(*(element_from_id[elem] for elem in child))
        
        remaining = [e for e in seq2 if e not in child]
        for elem in remaining:
            if any(n in active_nodes for n in element_from_id[elem]):
                child.append(elem)
                active_nodes.update(element_from_id[elem])
        
        if len(child) < len(seq1):
            remaining = [e for e in seq1 if e not in child]
            for elem in remaining:
                if any(n in active_nodes for n in element_from_id[elem]):
                    child.append(elem)
                    active_nodes.update(element_from_id[elem])
        
        offspring.append([all_elements.index(e) for e in child])
    
    return np.array(offspring)

def feasible_mutation(offspring, ga_instance, initial_temp=1000, cooling_rate=0.95):
    """Mutation operator with simulated annealing maintaining feasibility."""
    element_from_id = {e.ind: tuple(e.node_inds) for e in Model_in.elems}
    ground_nodes = {s.node_ind for s in Model_in.supports}
    current_temp = initial_temp * (cooling_rate ** ga_instance.generations_completed)
    
    for solution_idx in range(offspring.shape[0]):
        seq = [all_elements[int(i)] for i in offspring[solution_idx]]
        if random.random() < ga_instance.mutation_probability:
            pos1, pos2 = random.sample(range(len(seq)), 2)
            new_seq = seq.copy()
            new_seq[pos1], new_seq[pos2] = new_seq[pos2], new_seq[pos1]
            if check_sequence_feasibility(Model_in, new_seq):
                old_fitness = -evaluate_sequence(Model_in, seq, "displacement")
                new_fitness = -evaluate_sequence(Model_in, new_seq, "displacement")
                if new_fitness > old_fitness or random.random() < math.exp((new_fitness - old_fitness) / current_temp):
                    seq = new_seq
        offspring[solution_idx] = [all_elements.index(e) for e in seq]
    
    return offspring

def get_ga_config(objective, CroSecs_in=None):
    """Get GA configuration based on optimization objective."""
    base_params = {
        "num_parents_mating": 10,
        "sol_per_pop": 20,
        "num_genes": num_elements,
        "gene_type": int,
        "gene_space": list(range(num_elements)),
        "mutation_probability": 0.6,
        "crossover_probability": 0.8,
        "parent_selection_type": "tournament",
        "keep_elitism": 1,
        "keep_parents": 0,
        "allow_duplicate_genes": False,
        "on_generation": lambda ga: on_generation(ga),
        "num_generations": 3000,
        "stop_criteria": ["reach_0", "saturate_200"],
        "crossover_type": feasible_crossover,
        "mutation_type": lambda offspring, ga: feasible_mutation(offspring, ga, initial_temp=10000, cooling_rate=0.99),
    }
    
    if objective == "displacement":
        return {**base_params, "fitness_func": fitness_func_max_disp}
    elif objective == "stress":
        if CroSecs_in is None:
            raise ValueError("Cross-section (CroSecs_in) must be provided for stress objective!")
        return {**base_params, "fitness_func": lambda ga, sol, idx: fitness_func_max_stress(ga, sol, idx, CroSecs_in)}
    
    raise ValueError(f"Unsupported objective: {objective}")

# Main optimization
if 'activate' in globals() and activate and 'Model_in' in globals() and Model_in:
    all_elements = [elem.ind for elem in Model_in.elems]
    num_elements = len(all_elements)
    fitness_history = []
    current_best_fitness = float('-inf')
    
    def on_generation(ga_instance):
        """Callback for each generation."""
        global current_best_fitness
        best_fitness = ga_instance.best_solution()[1]
        current_best_fitness = best_fitness
        fitness_history.append(-best_fitness)
        if ga_instance.generations_completed % 100 == 0:
            print(f"Generation {ga_instance.generations_completed}, Best Fitness: {-best_fitness:.8f}")

    try:
        ga_params = get_ga_config(objective, CroSecs_in)
        ga_instance = pygad.GA(**ga_params)
        initialize_with_feasible_population(ga_instance, Model_in)
        print(f"Starting GA run for {objective} optimization...")
        ga_instance.run()
        
        solution, fitness, _ = ga_instance.best_solution()
        opt_seq = [all_elements[int(i)] for i in solution]
        result_value = evaluate_sequence(Model_in, opt_seq, objective=objective, CroSecs_in=CroSecs_in)
        
        print("\nOptimization Results:")
        print(f"Optimized Sequence: {opt_seq}")
        print(f"Max {'Displacement' if objective == 'displacement' else 'Stress'}: {result_value}")
        print(f"Generations Completed: {ga_instance.generations_completed}")
        print(f"Cached Sequences Size: {len(cached_results)}")
        
        total_evaluations = cache_hits + cache_misses
        cache_hit_rate = cache_hits / total_evaluations * 100 if total_evaluations > 0 else 0
        print(f"\nCache Statistics:")
        print(f"Sequence Evaluations: {total_evaluations}")
        print(f"Cache Hits: {cache_hits}")
        print(f"Cache Misses: {cache_misses}")
        print(f"Cache Hit Rate: {cache_hit_rate:.2f}%")
        
    except Exception as e:
        print(f"GA execution failed: {e}")
        raise
    finally:
        cached_results.clear()
        print("Cache cleared. Current cache size:", len(cached_results))
else:
    print("GA not activated or Model_in not defined.")
# ---------- end python_3_script_4 ----------
activate_7 = BooleanToggle(False)
activate_8 = BooleanToggle(False)
python_3_script_5 = Python3Script(activate=activate_4, Model_in=assemble_model_karamba3d.Model, objective=objective_2, CroSecs_in=cross_section_karamba3d)  # -> out, Model_out, flatten(opt_seq), flatten(fitness_history)
# ---------- python_3_script_5: Python ----------
import math
import random
import pygad
from collections import defaultdict
import numpy as np

# Karamba imports
import Karamba.Models
import Karamba.Elements
import Karamba.Results
from System.Collections.Generic import List
from System import String
from Karamba.Algorithms import Analyze
from Karamba.Results import BeamResultantForces, NodeDisplacements

# Global variables
cached_results = defaultdict(lambda: (float('inf'), -1))  # (value, early_stop_idx)
cache_hits = 0
cache_misses = 0
current_best_fitness = float('-inf')

def check_sequence_feasibility(model, sequence):
    """Check if a construction sequence is feasible."""
    try:
        element_from_id = {e.ind: tuple(e.node_inds) for e in model.elems}
        ground_nodes = {s.node_ind for s in model.supports}
        active_nodes, active_elements = set(ground_nodes), set()
        
        for elem in sequence:
            node1, node2 = element_from_id[elem]
            if node1 not in active_nodes and node2 not in active_nodes:
                return False
            active_elements.add(elem)
            active_nodes.add(node1)
            active_nodes.add(node2)
        return True
    except Exception as e:
        print(f"Feasibility check error: {e}")
        return False

def evaluate_sequence(model, sequence, objective="displacement", CroSecs_in=None):
    """Evaluate a construction sequence with caching, early termination, and early stop index recording."""
    global cache_hits, cache_misses, current_best_fitness
    
    if not check_sequence_feasibility(model, sequence):
        return float("inf")
    
    fea_model = model.Clone()
    fea_model.cloneElements()
    load_cases = ["LC0"]
    max_value = 0.0
    
    if objective == "displacement":
        disps = []
        active_nodes = set()
        element_node_map = {e.ind: set(e.node_inds) for e in fea_model.elems}
        
        for i, elem_ind in enumerate(sequence):
            active_nodes.update(element_node_map[elem_ind])
            sub_seq = tuple(sequence[:i + 1])
            sub_key = (sub_seq, objective)
            
            if sub_key in cached_results:
                cache_hits += 1
                current_disp, _ = cached_results[sub_key]
            else:
                cache_misses += 1
                for ele in fea_model.elems:
                    ele.set_is_active(fea_model, ele.ind in sub_seq)
                
                _, _, _, out_model, _ = Analyze.solve(fea_model, load_cases)
                node_indices = List[int](active_nodes)
                trans, _, _, _, _ = NodeDisplacements.solve(out_model, load_cases[0], node_indices)
                
                max_disp = max(math.sqrt(t.X**2 + t.Y**2 + t.Z**2) for nt in trans for t in nt)
                current_disp = max_disp * 1000  # Convert to mm
                cached_results[sub_key] = (current_disp, i)  # Cache value and early stop index
            
            disps.append(current_disp)
            max_value = max(disps)
            
            if -max_value < current_best_fitness:
                cached_results[sub_key] = (max_value, i)  # Update cache with early stop index
                return max_value
                
        cached_results[tuple(sequence), objective] = (max_value, len(sequence))  # No early stop
        return max_value
        
    elif objective == "stress":
        if CroSecs_in is None:
            raise ValueError("Cross-section (CroSecs_in) must be provided for stress objective!")
            
        stresses = []
        for i, elem_ind in enumerate(sequence):
            sub_seq = tuple(sequence[:i + 1])
            sub_key = (sub_seq, objective)
            
            if sub_key in cached_results:
                cache_hits += 1
                current_stress, _ = cached_results[sub_key]
            else:
                cache_misses += 1
                for ele in fea_model.elems:
                    ele.set_is_active(fea_model, ele.ind in sub_seq)
                
                _, _, _, out_model, _ = Analyze.solve(fea_model, load_cases)
                max_stress = 0.0
                
                for elem_ind in sub_seq:
                    beam = out_model.elems[elem_ind]
                    if not isinstance(beam, Karamba.Elements.ModelBeam):
                        continue
                    
                    elem_id = List[String]([str(elem_ind)])
                    N, V, M = BeamResultantForces.solve(out_model, elem_id, load_cases[0], 1, 1)
                    axial_stress = abs(N[0][0]) / CroSecs_in.A
                    bending_stress = abs(M[0][0]) / CroSecs_in.Wely_z_pos
                    total_stress = (axial_stress + bending_stress) / 1e3  # Convert to MPa
                    max_stress = max(max_stress, total_stress)
                
                current_stress = max_stress
                cached_results[sub_key] = (current_stress, i)  # Cache value and early stop index
            
            stresses.append(current_stress)
            max_value = max(stresses)
            
            if -max_value < current_best_fitness:
                cached_results[sub_key] = (max_value, i)  # Update cache with early stop index
                return max_value
                
        cached_results[tuple(sequence), objective] = (max_value, len(sequence))  # No early stop
        return max_value
    
    raise ValueError(f"Unsupported objective: {objective}")

def fitness_func_max_disp(ga_instance, solution, solution_idx):
    """Fitness function for displacement minimization."""
    global current_best_fitness
    sequence = [int(all_elements[i]) for i in solution]
    fitness = -evaluate_sequence(Model_in, sequence, objective="displacement")
    current_best_fitness = max(current_best_fitness, fitness)
    return fitness

def fitness_func_max_stress(ga_instance, solution, solution_idx, CroSecs_in):
    """Fitness function for stress minimization."""
    global current_best_fitness
    sequence = [int(all_elements[i]) for i in solution]
    fitness = -evaluate_sequence(Model_in, sequence, objective="stress", CroSecs_in=CroSecs_in)
    current_best_fitness = max(current_best_fitness, fitness)
    return fitness

def compute_element_distances(model):
    """Compute minimum distance from each element to any support node."""
    element_from_id = {e.ind: tuple(e.node_inds) for e in model.elems}
    ground_nodes = {s.node_ind for s in model.supports}
    distances = {}
    
    for elem_id, (node1, node2) in element_from_id.items():
        pos1, pos2 = model.nodes[node1].pos, model.nodes[node2].pos
        min_dist = float('inf')
        for ground_node in ground_nodes:
            ground_pos = model.nodes[ground_node].pos
            dist1 = math.sqrt(sum((getattr(pos1, dim) - getattr(ground_pos, dim))**2 for dim in ('X', 'Y', 'Z')))
            dist2 = math.sqrt(sum((getattr(pos2, dim) - getattr(ground_pos, dim))**2 for dim in ('X', 'Y', 'Z')))
            min_dist = min(min_dist, dist1, dist2)
        distances[elem_id] = min_dist
    
    return distances

def generate_feasible_initial_solution(model, element_distances, randomness=0.4):
    """Generate a single feasible construction sequence prioritizing proximity to supports."""
    try:
        element_from_id = {e.ind: tuple(e.node_inds) for e in model.elems}
        ground_nodes = {s.node_ind for s in model.supports}
        active_nodes, remaining_elements = set(ground_nodes), set(element_from_id.keys())
        sequence = []
        
        while remaining_elements:
            feasible_elements = [e for e in remaining_elements 
                               if any(n in active_nodes for n in element_from_id[e])]
            if not feasible_elements:
                print("Warning: Construction sequence generation failed!")
                return None
            
            feasible_elements.sort(key=lambda e: element_distances[e])
            elem = (random.choice(feasible_elements[:max(3, len(feasible_elements)//2)])
                    if random.random() < randomness and len(feasible_elements) > 1
                    else feasible_elements[0])
            
            sequence.append(elem)
            active_nodes.update(element_from_id[elem])
            remaining_elements.remove(elem)
            
        return sequence if check_sequence_feasibility(model, sequence) else None
    except Exception as e:
        print(f"Initial solution error: {e}")
        return None

def generate_feasible_population(model, pop_size, all_elements):
    """Generate a population of feasible construction sequences."""
    population = []
    seen_sequences = set()
    element_distances = compute_element_distances(model)
    
    while len(population) < pop_size:
        feasible_seq = generate_feasible_initial_solution(model, element_distances, randomness=0.2)
        if feasible_seq:
            seq_tuple = tuple(feasible_seq)
            if seq_tuple not in seen_sequences:
                population.append([all_elements.index(e) for e in feasible_seq])
                seen_sequences.add(seq_tuple)
                
    return population

def initialize_with_feasible_population(ga_instance, model):
    """Initialize GA with feasible population."""
    pop = generate_feasible_population(model, ga_instance.sol_per_pop, all_elements)
    ga_instance.population = np.array(pop)
    print(f"Initialized population with {len(pop)} feasible solutions")

def feasible_crossover(parents, offspring_size, ga_instance):
    """Crossover operator maintaining feasibility, with crossover point before early stopping."""
    offspring = []
    element_from_id = {e.ind: tuple(e.node_inds) for e in Model_in.elems}
    ground_nodes = {s.node_ind for s in Model_in.supports}
    objective = "displacement" if ga_instance.fitness_func.__name__.endswith("disp") else "stress"
    CroSecs_in = getattr(ga_instance, 'CroSecs_in', None) if objective == "stress" else None
    
    for _ in range(offspring_size[0]):
        parent1, parent2 = parents[np.random.choice(len(parents), 2, replace=False)]
        seq1 = [all_elements[int(i)] for i in parent1]
        seq2 = [all_elements[int(i)] for i in parent2]
        
        # Get early stopping index from cache for parent1
        seq1_key = (tuple(seq1), objective)
        if seq1_key in cached_results:
            _, early_stop_idx = cached_results[seq1_key]
        else:
            # Evaluate sequence to ensure cache is populated
            evaluate_sequence(Model_in, seq1, objective, CroSecs_in)
            _, early_stop_idx = cached_results[seq1_key]
        
        # Choose crossover point as the position before early stopping, or random if no early stop
        if early_stop_idx < len(seq1):
            point = early_stop_idx
        else:
            point = random.randint(1, len(seq1) - 1)
        
        child = seq1[:point]
        active_nodes = set(ground_nodes).union(*(element_from_id[elem] for elem in child))
        
        # Add remaining elements from parent2 that are feasible
        remaining = [e for e in seq2 if e not in child]
        for elem in remaining:
            if any(n in active_nodes for n in element_from_id[elem]):
                child.append(elem)
                active_nodes.update(element_from_id[elem])
        
        # If child is incomplete, add remaining feasible elements from parent1
        if len(child) < len(seq1):
            remaining = [e for e in seq1 if e not in child]
            for elem in remaining:
                if any(n in active_nodes for n in element_from_id[elem]):
                    child.append(elem)
                    active_nodes.update(element_from_id[elem])
        
        # Ensure child is feasible; if not, revert to parent1
        if check_sequence_feasibility(Model_in, child):
            offspring.append([all_elements.index(e) for e in child])
        else:
            offspring.append(parent1)
    
    return np.array(offspring)

def feasible_mutation(offspring, ga_instance, initial_temp=1000, cooling_rate=0.95):
    """Mutation operator with simulated annealing maintaining feasibility."""
    element_from_id = {e.ind: tuple(e.node_inds) for e in Model_in.elems}
    ground_nodes = {s.node_ind for s in Model_in.supports}
    current_temp = initial_temp * (cooling_rate ** ga_instance.generations_completed)
    
    for solution_idx in range(offspring.shape[0]):
        seq = [all_elements[int(i)] for i in offspring[solution_idx]]
        if random.random() < ga_instance.mutation_probability:
            pos1, pos2 = random.sample(range(len(seq)), 2)
            new_seq = seq.copy()
            new_seq[pos1], new_seq[pos2] = new_seq[pos2], new_seq[pos1]
            if check_sequence_feasibility(Model_in, new_seq):
                old_fitness = -evaluate_sequence(Model_in, seq, "displacement")
                new_fitness = -evaluate_sequence(Model_in, new_seq, "displacement")
                if new_fitness > old_fitness or random.random() < math.exp((new_fitness - old_fitness) / current_temp):
                    seq = new_seq
        offspring[solution_idx] = [all_elements.index(e) for e in seq]
    
    return offspring

def get_ga_config(objective, CroSecs_in=None):
    """Get GA configuration based on optimization objective."""
    base_params = {
        "num_parents_mating": 10,
        "sol_per_pop": 20,
        "num_genes": num_elements,
        "gene_type": int,
        "gene_space": list(range(num_elements)),
        "mutation_probability": 0.6,
        "crossover_probability": 0.8,
        "parent_selection_type": "tournament",
        "keep_elitism": 1,
        "keep_parents": 0,
        "allow_duplicate_genes": False,
        "on_generation": lambda ga: on_generation(ga),
        "num_generations": 3000,
        "stop_criteria": ["reach_0", "saturate_200"],
        "crossover_type": feasible_crossover,
        "mutation_type": lambda offspring, ga: feasible_mutation(offspring, ga, initial_temp=10000, cooling_rate=0.995),
    }
    
    if objective == "displacement":
        return {**base_params, "fitness_func": fitness_func_max_disp}
    elif objective == "stress":
        if CroSecs_in is None:
            raise ValueError("Cross-section (CroSecs_in) must be provided for stress objective!")
        return {**base_params, "fitness_func": lambda ga, sol, idx: fitness_func_max_stress(ga, sol, idx, CroSecs_in), "CroSecs_in": CroSecs_in}
    
    raise ValueError(f"Unsupported objective: {objective}")

# Main optimization
if 'activate' in globals() and activate and 'Model_in' in globals() and Model_in:
    all_elements = [elem.ind for elem in Model_in.elems]
    num_elements = len(all_elements)
    fitness_history = []
    current_best_fitness = float('-inf')
    
    def on_generation(ga_instance):
        """Callback for each generation."""
        global current_best_fitness
        best_fitness = ga_instance.best_solution()[1]
        current_best_fitness = best_fitness
        fitness_history.append(-best_fitness)
        if ga_instance.generations_completed % 100 == 0:
            print(f"Generation {ga_instance.generations_completed}, Best Fitness: {-best_fitness:.8f}")
    
    try:
        ga_params = get_ga_config(objective, CroSecs_in)
        ga_instance = pygad.GA(**ga_params)
        initialize_with_feasible_population(ga_instance, Model_in)
        print(f"Starting GA run for {objective} optimization...")
        ga_instance.run()
        
        solution, fitness, _ = ga_instance.best_solution()
        opt_seq = [all_elements[int(i)] for i in solution]
        result_value = evaluate_sequence(Model_in, opt_seq, objective=objective, CroSecs_in=CroSecs_in)
        
        print("\nOptimization Results:")
        print(f"Optimized Sequence: {opt_seq}")
        print(f"Max {'Displacement' if objective == 'displacement' else 'Stress'}: {result_value}")
        print(f"Generations Completed: {ga_instance.generations_completed}")
        print(f"Cached Sequences Size: {len(cached_results)}")
        
        total_evaluations = cache_hits + cache_misses
        cache_hit_rate = cache_hits / total_evaluations * 100 if total_evaluations > 0 else 0
        print(f"\nCache Statistics:")
        print(f"Sequence Evaluations: {total_evaluations}")
        print(f"Cache Hits: {cache_hits}")
        print(f"Cache Misses: {cache_misses}")
        print(f"Cache Hit Rate: {cache_hit_rate:.2f}%")
        
    except Exception as e:
        print(f"GA execution failed: {e}")
        raise
    finally:
        cached_results.clear()
        print("Cache cleared. Current cache size:", len(cached_results))
else:
    print("GA not activated or Model_in not defined.")
# ---------- end python_3_script_5 ----------
python_3_script_6 = Python3Script(activate=activate_5, Model_in=assemble_model_karamba3d.Model, objective=objective_3, CroSecs_in=cross_section_karamba3d)  # -> out, Model_out, flatten(opt_seq), flatten(fitness_history)
# ---------- python_3_script_6: Python ----------
import math
import random
import pygad
from collections import defaultdict
import numpy as np

# Karamba imports
import Karamba.Models
import Karamba.Elements
import Karamba.Results
from System.Collections.Generic import List
from System import String
from Karamba.Algorithms import Analyze
from Karamba.Results import BeamResultantForces, NodeDisplacements

# Global variables
cached_results = defaultdict(lambda: (float('inf'), -1))  # (value, early_stop_idx)
cache_hits = 0
cache_misses = 0
current_best_fitness = float('-inf')

def check_sequence_feasibility(model, sequence):
    """Check if a construction sequence is feasible."""
    try:
        element_from_id = {e.ind: tuple(e.node_inds) for e in model.elems}
        ground_nodes = {s.node_ind for s in model.supports}
        active_nodes, active_elements = set(ground_nodes), set()
        
        for elem in sequence:
            node1, node2 = element_from_id[elem]
            if node1 not in active_nodes and node2 not in active_nodes:
                return False
            active_elements.add(elem)
            active_nodes.add(node1)
            active_nodes.add(node2)
        return True
    except Exception as e:
        print(f"Feasibility check error: {e}")
        return False

def evaluate_sequence(model, sequence, objective="displacement", CroSecs_in=None):
    """Evaluate a construction sequence with caching, early termination, and early stop index recording."""
    global cache_hits, cache_misses, current_best_fitness
    
    if not check_sequence_feasibility(model, sequence):
        return float("inf")
    
    fea_model = model.Clone()
    fea_model.cloneElements()
    load_cases = ["LC0"]
    max_value = 0.0
    
    if objective == "displacement":
        disps = []
        active_nodes = set()
        element_node_map = {e.ind: set(e.node_inds) for e in fea_model.elems}
        
        for i, elem_ind in enumerate(sequence):
            active_nodes.update(element_node_map[elem_ind])
            sub_seq = tuple(sequence[:i + 1])
            sub_key = (sub_seq, objective)
            
            if sub_key in cached_results:
                cache_hits += 1
                current_disp, _ = cached_results[sub_key]
            else:
                cache_misses += 1
                for ele in fea_model.elems:
                    ele.set_is_active(fea_model, ele.ind in sub_seq)
                
                _, _, _, out_model, _ = Analyze.solve(fea_model, load_cases)
                node_indices = List[int](active_nodes)
                trans, _, _, _, _ = NodeDisplacements.solve(out_model, load_cases[0], node_indices)
                
                max_disp = max(math.sqrt(t.X**2 + t.Y**2 + t.Z**2) for nt in trans for t in nt)
                current_disp = max_disp * 1000  # Convert to mm
                cached_results[sub_key] = (current_disp, i)  # Cache value and early stop index
            
            disps.append(current_disp)
            max_value = max(disps)
            
            if -max_value < current_best_fitness:
                cached_results[sub_key] = (max_value, i)  # Update cache with early stop index
                return max_value
                
        cached_results[tuple(sequence), objective] = (max_value, len(sequence))  # No early stop
        return max_value
        
    elif objective == "stress":
        if CroSecs_in is None:
            raise ValueError("Cross-section (CroSecs_in) must be provided for stress objective!")
            
        stresses = []
        for i, elem_ind in enumerate(sequence):
            sub_seq = tuple(sequence[:i + 1])
            sub_key = (sub_seq, objective)
            
            if sub_key in cached_results:
                cache_hits += 1
                current_stress, _ = cached_results[sub_key]
            else:
                cache_misses += 1
                for ele in fea_model.elems:
                    ele.set_is_active(fea_model, ele.ind in sub_seq)
                
                _, _, _, out_model, _ = Analyze.solve(fea_model, load_cases)
                max_stress = 0.0
                
                for elem_ind in sub_seq:
                    beam = out_model.elems[elem_ind]
                    if not isinstance(beam, Karamba.Elements.ModelBeam):
                        continue
                    
                    elem_id = List[String]([str(elem_ind)])
                    N, V, M = BeamResultantForces.solve(out_model, elem_id, load_cases[0], 1, 1)
                    axial_stress = abs(N[0][0]) / CroSecs_in.A
                    bending_stress = abs(M[0][0]) / CroSecs_in.Wely_z_pos
                    total_stress = (axial_stress + bending_stress) / 1e3  # Convert to MPa
                    max_stress = max(max_stress, total_stress)
                
                current_stress = max_stress
                cached_results[sub_key] = (current_stress, i)  # Cache value and early stop index
            
            stresses.append(current_stress)
            max_value = max(stresses)
            
            if -max_value < current_best_fitness:
                cached_results[sub_key] = (max_value, i)  # Update cache with early stop index
                return max_value
                
        cached_results[tuple(sequence), objective] = (max_value, len(sequence))  # No early stop
        return max_value
    
    raise ValueError(f"Unsupported objective: {objective}")

def fitness_func_max_disp(ga_instance, solution, solution_idx):
    """Fitness function for displacement minimization."""
    global current_best_fitness
    sequence = [int(all_elements[i]) for i in solution]
    fitness = -evaluate_sequence(Model_in, sequence, objective="displacement")
    current_best_fitness = max(current_best_fitness, fitness)
    return fitness

def fitness_func_max_stress(ga_instance, solution, solution_idx):
    """Fitness function for stress minimization."""
    global current_best_fitness
    sequence = [int(all_elements[i]) for i in solution]
    CroSecs_in = getattr(ga_instance, 'CroSecs_in', None)
    if CroSecs_in is None:
        raise ValueError("CroSecs_in must be provided for stress objective!")
    fitness = -evaluate_sequence(Model_in, sequence, objective="stress", CroSecs_in=CroSecs_in)
    current_best_fitness = max(current_best_fitness, fitness)
    return fitness

def compute_element_distances(model):
    """Compute minimum distance from each element to any support node."""
    element_from_id = {e.ind: tuple(e.node_inds) for e in model.elems}
    ground_nodes = {s.node_ind for s in model.supports}
    distances = {}
    
    for elem_id, (node1, node2) in element_from_id.items():
        pos1, pos2 = model.nodes[node1].pos, model.nodes[node2].pos
        min_dist = float('inf')
        for ground_node in ground_nodes:
            ground_pos = model.nodes[ground_node].pos
            dist1 = math.sqrt(sum((getattr(pos1, dim) - getattr(ground_pos, dim))**2 for dim in ('X', 'Y', 'Z')))
            dist2 = math.sqrt(sum((getattr(pos2, dim) - getattr(ground_pos, dim))**2 for dim in ('X', 'Y', 'Z')))
            min_dist = min(min_dist, dist1, dist2)
        distances[elem_id] = min_dist
    
    return distances

def generate_feasible_initial_solution(model, element_distances, objective="displacement", CroSecs_in=None, greediness=0.8):
    """Generate a single feasible construction sequence using greedy selection based on objective."""
    try:
        element_from_id = {e.ind: tuple(e.node_inds) for e in model.elems}
        ground_nodes = {s.node_ind for s in model.supports}
        active_nodes, remaining_elements = set(ground_nodes), set(element_from_id.keys())
        sequence = []
        
        while remaining_elements:
            feasible_elements = [e for e in remaining_elements 
                               if any(n in active_nodes for n in element_from_id[e])]
            if not feasible_elements:
                print("Warning: Construction sequence generation failed!")
                return None
            
            # Evaluate each feasible element by appending it to the current sequence
            element_scores = []
            for elem in feasible_elements:
                temp_seq = sequence + [elem]
                score = evaluate_sequence(model, temp_seq, objective, CroSecs_in)
                element_scores.append((elem, score))
            
            # Sort by score (ascending, as we want to minimize displacement/stress)
            element_scores.sort(key=lambda x: x[1])
            
            # Select from top (1 - greediness) fraction of elements
            num_candidates = max(1, math.ceil(len(feasible_elements) * (1 - greediness)))
            candidates = [elem for elem, _ in element_scores[:num_candidates]]
            
            # Randomly choose one from candidates
            chosen_elem = random.choice(candidates)
            
            sequence.append(chosen_elem)
            active_nodes.update(element_from_id[chosen_elem])
            remaining_elements.remove(chosen_elem)
            
        return sequence if check_sequence_feasibility(model, sequence) else None
    except Exception as e:
        print(f"Initial solution error: {e}")
        return None

def generate_feasible_population(model, pop_size, all_elements, objective="displacement", CroSecs_in=None):
    """Generate a population of feasible construction sequences."""
    population = []
    seen_sequences = set()
    element_distances = compute_element_distances(model)
    
    while len(population) < pop_size:
        feasible_seq = generate_feasible_initial_solution(
            model, element_distances, objective, CroSecs_in, greediness=0.8
        )
        if feasible_seq:
            seq_tuple = tuple(feasible_seq)
            if seq_tuple not in seen_sequences:
                population.append([all_elements.index(e) for e in feasible_seq])
                seen_sequences.add(seq_tuple)
                
    return population

def initialize_with_feasible_population(ga_instance, model):
    """Initialize GA with feasible population."""
    objective = "displacement" if ga_instance.fitness_func.__name__.endswith("disp") else "stress"
    CroSecs_in = getattr(ga_instance, 'CroSecs_in', None)
    pop = generate_feasible_population(
        model, 
        ga_instance.sol_per_pop, 
        all_elements, 
        objective=objective,
        CroSecs_in=CroSecs_in
    )
    ga_instance.population = np.array(pop)
    print(f"Initialized population with {len(pop)} feasible solutions")

def feasible_crossover(parents, offspring_size, ga_instance):
    """Crossover operator maintaining feasibility, with crossover point before early stopping."""
    offspring = []
    element_from_id = {e.ind: tuple(e.node_inds) for e in Model_in.elems}
    ground_nodes = {s.node_ind for s in Model_in.supports}
    objective = "displacement" if ga_instance.fitness_func.__name__.endswith("disp") else "stress"
    CroSecs_in = getattr(ga_instance, 'CroSecs_in', None) if objective == "stress" else None
    
    for _ in range(offspring_size[0]):
        parent1, parent2 = parents[np.random.choice(len(parents), 2, replace=False)]
        seq1 = [all_elements[int(i)] for i in parent1]
        seq2 = [all_elements[int(i)] for i in parent2]
        
        # Get early stopping index from cache for parent1
        seq1_key = (tuple(seq1), objective)
        if seq1_key in cached_results:
            _, early_stop_idx = cached_results[seq1_key]
        else:
            # Evaluate sequence to ensure cache is populated
            evaluate_sequence(Model_in, seq1, objective, CroSecs_in)
            _, early_stop_idx = cached_results[seq1_key]
        
        # Choose crossover point as the position before early stopping, or random if no early stop
        if early_stop_idx < len(seq1):
            point = early_stop_idx
        else:
            point = random.randint(1, len(seq1) - 1)
        
        child = seq1[:point]
        active_nodes = set(ground_nodes).union(*(element_from_id[elem] for elem in child))
        
        # Add remaining elements from parent2 that are feasible
        remaining = [e for e in seq2 if e not in child]
        for elem in remaining:
            if any(n in active_nodes for n in element_from_id[elem]):
                child.append(elem)
                active_nodes.update(element_from_id[elem])
        
        # If child is incomplete, add remaining feasible elements from parent1
        if len(child) < len(seq1):
            remaining = [e for e in seq1 if e not in child]
            for elem in remaining:
                if any(n in active_nodes for n in element_from_id[elem]):
                    child.append(elem)
                    active_nodes.update(element_from_id[elem])
        
        # Ensure child is feasible; if not, revert to parent1
        if check_sequence_feasibility(Model_in, child):
            offspring.append([all_elements.index(e) for e in child])
        else:
            offspring.append(parent1)
    
    return np.array(offspring)

def feasible_mutation(offspring, ga_instance, initial_temp=1000, cooling_rate=0.95):
    """Mutation operator with simulated annealing maintaining feasibility."""
    element_from_id = {e.ind: tuple(e.node_inds) for e in Model_in.elems}
    ground_nodes = {s.node_ind for s in Model_in.supports}
    current_temp = initial_temp * (cooling_rate ** ga_instance.generations_completed)
    
    for solution_idx in range(offspring.shape[0]):
        seq = [all_elements[int(i)] for i in offspring[solution_idx]]
        if random.random() < ga_instance.mutation_probability:
            pos1, pos2 = random.sample(range(len(seq)), 2)
            new_seq = seq.copy()
            new_seq[pos1], new_seq[pos2] = new_seq[pos2], new_seq[pos1]
            if check_sequence_feasibility(Model_in, new_seq):
                old_fitness = -evaluate_sequence(Model_in, seq, "displacement")
                new_fitness = -evaluate_sequence(Model_in, new_seq, "displacement")
                if new_fitness > old_fitness or random.random() < math.exp((new_fitness - old_fitness) / current_temp):
                    seq = new_seq
        offspring[solution_idx] = [all_elements.index(e) for e in seq]
    
    return offspring

def get_ga_config(objective, CroSecs_in=None):
    """Get GA configuration based on optimization objective."""
    base_params = {
        "num_parents_mating": 10,
        "sol_per_pop": 20,
        "num_genes": num_elements,
        "gene_type": int,
        "gene_space": list(range(num_elements)),
        "mutation_probability": 0.6,
        "crossover_probability": 0.8,
        "parent_selection_type": "tournament",
        "keep_elitism": 1,
        "keep_parents": 0,
        "allow_duplicate_genes": False,
        "on_generation": lambda ga: on_generation(ga),
        "num_generations": 3000,
        "stop_criteria": ["reach_0", "saturate_200"],
        "crossover_type": feasible_crossover,
        "mutation_type": lambda offspring, ga: feasible_mutation(offspring, ga, initial_temp=10000, cooling_rate=0.99),
    }
    
    if objective == "displacement":
        return {**base_params, "fitness_func": fitness_func_max_disp}
    elif objective == "stress":
        if CroSecs_in is None:
            raise ValueError("Cross-section (CroSecs_in) must be provided for stress objective!")
        return {**base_params, "fitness_func": fitness_func_max_stress}
    
    raise ValueError(f"Unsupported objective: {objective}")

# Main optimization
if 'activate' in globals() and activate and 'Model_in' in globals() and Model_in:
    all_elements = [elem.ind for elem in Model_in.elems]
    num_elements = len(all_elements)
    fitness_history = []
    current_best_fitness = float('-inf')
    
    def on_generation(ga_instance):
        """Callback for each generation."""
        global current_best_fitness
        best_fitness = ga_instance.best_solution()[1]
        current_best_fitness = best_fitness
        fitness_history.append(-best_fitness)
        if ga_instance.generations_completed % 100 == 0:
            print(f"Generation {ga_instance.generations_completed}, Best Fitness: {-best_fitness:.8f}")
    
    try:
        ga_params = get_ga_config(objective, CroSecs_in)
        ga_instance = pygad.GA(**ga_params)
        if objective == "stress":
            ga_instance.CroSecs_in = CroSecs_in  # Attach CroSecs_in for stress objective
        initialize_with_feasible_population(ga_instance, Model_in)
        print(f"Starting GA run for {objective} optimization...")
        ga_instance.run()
        
        solution, fitness, _ = ga_instance.best_solution()
        opt_seq = [all_elements[int(i)] for i in solution]
        CroSecs_in = getattr(ga_instance, 'CroSecs_in', None) if objective == "stress" else None
        result_value = evaluate_sequence(Model_in, opt_seq, objective=objective, CroSecs_in=CroSecs_in)
        
        print("\nOptimization Results:")
        print(f"Optimized Sequence: {opt_seq}")
        print(f"Max {'Displacement' if objective == 'displacement' else 'Stress'}: {result_value}")
        print(f"Generations Completed: {ga_instance.generations_completed}")
        print(f"Cached Sequences Size: {len(cached_results)}")
        
        total_evaluations = cache_hits + cache_misses
        cache_hit_rate = cache_hits / total_evaluations * 100 if total_evaluations > 0 else 0
        print(f"\nCache Statistics:")
        print(f"Sequence Evaluations: {total_evaluations}")
        print(f"Cache Hits: {cache_hits}")
        print(f"Cache Misses: {cache_misses}")
        print(f"Cache Hit Rate: {cache_hit_rate:.2f}%")
        
    except Exception as e:
        print(f"GA execution failed: {e}")
        raise
    finally:
        cached_results.clear()
        print("Cache cleared. Current cache size:", len(cached_results))
else:
    print("GA not activated or Model_in not defined.")
# ---------- end python_3_script_6 ----------
remap_numbers = RemapNumbers(Value=Slider(0.971, range=0..1), Source=Domain(0, 1), Target=list_length)  # -> Mapped, Clipped
python_3_script_7 = Python3Script(activate=activate_6, Model_in=assemble_model_karamba3d.Model, objective=objective_4, CroSecs_in=cross_section_karamba3d)  # -> out, Model_out
# ---------- python_3_script_7: Python ----------
import math
import random
import pygad
from collections import defaultdict
import numpy as np

# Karamba imports
import Karamba.Models
import Karamba.Elements
import Karamba.Results
from System.Collections.Generic import List
from System import String
from Karamba.Algorithms import Analyze
from Karamba.Results import BeamResultantForces, NodeDisplacements

# Global variables
cached_results = {}
cache_hits = 0
cache_misses = 0
current_best_fitness = float('-inf')

# Statistics counters
theoretical_fea_calls = 0
cached_no_early_stop_fea_calls = 0
cached_with_early_stop_fea_calls = 0
sequences_evaluated = 0

def check_sequence_feasibility(model, sequence):
    """Check if a construction sequence is feasible (all elements can be installed)."""
    try:
        element_from_id = {e.ind: tuple(e.node_inds) for e in model.elems}
        ground_nodes = {s.node_ind for s in model.supports}
        active_nodes, active_elements = set(ground_nodes), set()
        
        for elem in sequence:
            node1, node2 = element_from_id[elem]
            if node1 not in active_nodes and node2 not in active_nodes:
                return False
            active_elements.add(elem)
            active_nodes.add(node1)
            active_nodes.add(node2)
        return True
    except Exception as e:
        print(f"Feasibility check error: {e}")
        return False

def evaluate_sequence(model, sequence, objective="displacement", CroSecs_in=None, enable_early_stopping=True):
    """
    Evaluate a construction sequence with caching and optional early termination.
    Track cached no-early-stop and cached with-early-stop FEA calls per evaluation.
    """
    global cache_hits, cache_misses, current_best_fitness
    global cached_no_early_stop_fea_calls, cached_with_early_stop_fea_calls
    global sequences_evaluated
    
    sequences_evaluated += 1
    
    if not check_sequence_feasibility(model, sequence):
        return float("inf")
    
    try:
        fea_model = model.Clone()
        fea_model.cloneElements()
        load_cases = ["LC0"]
        max_value = 0.0
        stress_scale = 1e3  # Scaling factor for stress
        
        actual_fea_calls = 0  # Cached, no early stop
        early_stop_fea_calls = 0  # Cached with early stop
        early_stop_triggered = False
        
        if objective == "displacement":
            disps = []
            active_nodes = set()
            element_node_map = {e.ind: set(e.node_inds) for e in fea_model.elems}
            
            for i, elem_ind in enumerate(sequence):
                active_nodes.update(element_node_map[elem_ind])
                sub_seq = tuple(sequence[:i + 1])
                sub_key = (sub_seq, objective)
                
                if sub_key in cached_results:
                    cache_hits += 1
                    current_disp = cached_results[sub_key]
                else:
                    cache_misses += 1
                    actual_fea_calls += 1
                    if not early_stop_triggered:
                        early_stop_fea_calls += 1
                    
                    for ele in fea_model.elems:
                        ele.set_is_active(fea_model, ele.ind in sub_seq)
                    
                    _, _, _, out_model, _ = Analyze.solve(fea_model, load_cases)
                    node_indices = List[int](active_nodes)
                    trans, _, _, _, _ = NodeDisplacements.solve(out_model, load_cases[0], node_indices)
                    
                    max_disp = max(math.sqrt(t.X**2 + t.Y**2 + t.Z**2) for nt in trans for t in nt)
                    current_disp = max_disp * 1000  # Convert to mm
                    cached_results[sub_key] = current_disp
                
                disps.append(current_disp)
                max_value = max(disps)
                
                if enable_early_stopping and max_value > 0 and -max_value < current_best_fitness:
                    early_stop_triggered = True
            
            cached_no_early_stop_fea_calls += actual_fea_calls
            cached_with_early_stop_fea_calls += early_stop_fea_calls if early_stop_triggered else actual_fea_calls
            return max_value
            
        elif objective == "stress":
            if CroSecs_in is None or not hasattr(CroSecs_in, 'A') or not hasattr(CroSecs_in, 'Wely_z_pos'):
                raise ValueError("Valid Cross-section (CroSecs_in) must be provided for stress objective!")
                
            stresses = []
            for i, elem_ind in enumerate(sequence):
                sub_seq = tuple(sequence[:i + 1])
                sub_key = (sub_seq, objective, stress_scale)  # Include scale in cache key
                
                if sub_key in cached_results:
                    cache_hits += 1
                    current_stress = cached_results[sub_key]
                else:
                    cache_misses += 1
                    actual_fea_calls += 1
                    if not early_stop_triggered:
                        early_stop_fea_calls += 1
                    
                    for ele in fea_model.elems:
                        ele.set_is_active(fea_model, ele.ind in sub_seq)
                    
                    _, _, _, out_model, _ = Analyze.solve(fea_model, load_cases)
                    max_stress = 0.0
                    
                    for elem_ind in sub_seq:
                        beam = out_model.elems[elem_ind]
                        if not isinstance(beam, Karamba.Elements.ModelBeam):
                            continue
                        
                        elem_id = List[String]([str(elem_ind)])
                        N, V, M = BeamResultantForces.solve(out_model, elem_id, load_cases[0], 1, 1)
                        axial_stress = abs(N[0][0]) / CroSecs_in.A
                        bending_stress = abs(M[0][0]) / CroSecs_in.Wely_z_pos
                        total_stress = (axial_stress + bending_stress) / stress_scale  # Convert to MPa
                        max_stress = max(max_stress, total_stress)
                    
                    current_stress = max_stress
                    cached_results[sub_key] = current_stress
                
                stresses.append(current_stress)
                max_value = max(stresses)
                
                if enable_early_stopping and max_value > 0 and -max_value < current_best_fitness:
                    early_stop_triggered = True
            
            cached_no_early_stop_fea_calls += actual_fea_calls
            cached_with_early_stop_fea_calls += early_stop_fea_calls if early_stop_triggered else actual_fea_calls
            return max_value
        
        raise ValueError(f"Unsupported objective: {objective}")
    except Exception as e:
        print(f"Evaluation failed for sequence {sequence}: {e}")
        return float("inf")

def fitness_func_max_disp(ga_instance, solution, solution_idx):
    """Fitness function for displacement minimization."""
    global current_best_fitness
    sequence = [int(all_elements[i]) for i in solution]
    fitness = -evaluate_sequence(Model_in, sequence, objective="displacement")
    current_best_fitness = max(current_best_fitness, fitness)
    return fitness

def fitness_func_max_stress(ga_instance, solution, solution_idx, CroSecs_in):
    """Fitness function for stress minimization."""
    global current_best_fitness
    sequence = [int(all_elements[i]) for i in solution]
    fitness = -evaluate_sequence(Model_in, sequence, objective="stress", CroSecs_in=CroSecs_in)
    current_best_fitness = max(current_best_fitness, fitness)
    return fitness

def compute_element_distances(model):
    """Compute the minimum distance from each element to any support node."""
    element_from_id = {e.ind: tuple(e.node_inds) for e in model.elems}
    ground_nodes = {s.node_ind for s in model.supports}
    distances = {}
    
    for elem_id, (node1, node2) in element_from_id.items():
        pos1 = model.nodes[node1].pos
        pos2 = model.nodes[node2].pos
        min_dist = float('inf')
        for ground_node in ground_nodes:
            ground_pos = model.nodes[ground_node].pos
            dist1 = ((pos1.X - ground_pos.X)**2 + (pos1.Y - ground_pos.Y)**2 + (pos1.Z - ground_pos.Z)**2)**0.5
            dist2 = ((pos2.X - ground_pos.X)**2 + (pos2.Y - ground_pos.Y)**2 + (pos2.Z - ground_pos.Z)**2)**0.5
            min_dist = min(min_dist, dist1, dist2)
        distances[elem_id] = min_dist
    
    return distances

def generate_feasible_initial_solution(model, element_distances, randomness=0.4):
    """Generate a single feasible construction sequence."""
    try:
        element_from_id = {e.ind: tuple(e.node_inds) for e in model.elems}
        ground_nodes = {s.node_ind for s in model.supports}
        active_nodes, remaining_elements = set(ground_nodes), set(element_from_id.keys())
        sequence = []
        
        while remaining_elements:
            feasible_elements = [e for e in remaining_elements 
                               if any(n in active_nodes for n in element_from_id[e])]
            if not feasible_elements:
                print("Warning: Construction sequence generation failed!")
                return None
            
            feasible_elements.sort(key=lambda e: element_distances[e])
            if random.random() < randomness and len(feasible_elements) > 1:
                elem = random.choice(feasible_elements[:max(3, len(feasible_elements)//2)])
            else:
                elem = feasible_elements[0]
            
            sequence.append(elem)
            active_nodes.update(element_from_id[elem])
            remaining_elements.remove(elem)
            
        return sequence if check_sequence_feasibility(model, sequence) else None
    except Exception as e:
        print(f"Initial solution error: {e}")
        return None

def generate_feasible_population(model, pop_size, all_elements):
    """Generate a population of feasible construction sequences."""
    population = []
    seen_sequences = set()
    element_distances = compute_element_distances(model)
    
    while len(population) < pop_size:
        feasible_seq = generate_feasible_initial_solution(model, element_distances, randomness=0.2)
        if feasible_seq:
            seq_tuple = tuple(feasible_seq)
            if seq_tuple not in seen_sequences:
                element_to_index = {elem: i for i, elem in enumerate(all_elements)}
                population.append([element_to_index[e] for e in feasible_seq])
                seen_sequences.add(seq_tuple)
                
    return population

def initialize_with_feasible_population(ga_instance, model):
    """Initialize GA with feasible population."""
    pop = generate_feasible_population(model, ga_instance.sol_per_pop, all_elements)
    ga_instance.population = np.array(pop)
    print(f"Initialized population with {len(pop)} solutions, all feasible")

def feasible_crossover(parents, offspring_size, ga_instance):
    """Crossover operator that maintains feasibility."""
    offspring = []
    element_from_id = {e.ind: tuple(e.node_inds) for e in Model_in.elems}
    ground_nodes = {s.node_ind for s in Model_in.supports}
    
    for _ in range(offspring_size[0]):
        parent1, parent2 = parents[np.random.choice(len(parents), 2, replace=False)]
        seq1 = [all_elements[int(i)] for i in parent1]
        seq2 = [all_elements[int(i)] for i in parent2]
        
        point = random.randint(1, len(seq1) - 1)
        child = seq1[:point]
        active_nodes = set(ground_nodes)
        for elem in child:
            active_nodes.update(element_from_id[elem])
        
        remaining = [e for e in seq2 if e not in child]
        for elem in remaining:
            if any(n in active_nodes for n in element_from_id[elem]):
                child.append(elem)
                active_nodes.update(element_from_id[elem])
        
        if len(child) < len(seq1):
            remaining = [e for e in seq1 if e not in child]
            for elem in remaining:
                if any(n in active_nodes for n in element_from_id[elem]):
                    child.append(elem)
                    active_nodes.update(element_from_id[elem])
        
        element_to_index = {elem: i for i, elem in enumerate(all_elements)}
        offspring.append([element_to_index[e] for e in child])
    
    return np.array(offspring)

def feasible_mutation(offspring, ga_instance, initial_temp=1000, cooling_rate=0.95):
    """Mutation operator with simulated annealing."""
    element_from_id = {e.ind: tuple(e.node_inds) for e in Model_in.elems}
    ground_nodes = {s.node_ind for s in Model_in.supports}
    current_temp = initial_temp * (cooling_rate ** ga_instance.generations_completed)
    
    for solution_idx in range(offspring.shape[0]):
        seq = [all_elements[int(i)] for i in offspring[solution_idx]]
        if random.random() < ga_instance.mutation_probability:
            pos1, pos2 = random.sample(range(len(seq)), 2)
            new_seq = seq.copy()
            new_seq[pos1], new_seq[pos2] = new_seq[pos2], new_seq[pos1]
            if check_sequence_feasibility(Model_in, new_seq):
                old_fitness = -evaluate_sequence(Model_in, seq, "displacement")
                new_fitness = -evaluate_sequence(Model_in, new_seq, "displacement")
                delta = new_fitness - old_fitness
                if delta > 0 or random.random() < math.exp(delta / current_temp):
                    seq = new_seq
        element_to_index = {elem: i for i, elem in enumerate(all_elements)}
        offspring[solution_idx] = [element_to_index[e] for e in seq]
    
    return offspring

def get_ga_config(objective, CroSecs_in=None):
    """Get configuration for GA based on optimization objective."""
    base_params = {
        "num_parents_mating": 10,
        "sol_per_pop": 20,
        "num_genes": num_elements,
        "gene_type": int,
        "gene_space": list(range(num_elements)),
        "mutation_probability": 0.5,
        "crossover_probability": 0.8,
        "parent_selection_type": "tournament",
        "keep_elitism": 1,
        "keep_parents": 0,
        "allow_duplicate_genes": False,
        "on_generation": lambda ga: None,  # No per-generation output
        "num_generations": 3000,
        "stop_criteria": ["reach_0", "saturate_200"],
        "crossover_type": feasible_crossover,
        "mutation_type": lambda offspring, ga: feasible_mutation(offspring, ga, initial_temp=10000, cooling_rate=0.99),
    }
    
    if objective == "displacement":
        return {**base_params, "fitness_func": fitness_func_max_disp}
    elif objective == "stress":
        if CroSecs_in is None:
            raise ValueError("Cross-section (CroSecs_in) must be provided for stress objective!")
        return {**base_params, "fitness_func": lambda ga, sol, idx: fitness_func_max_stress(ga, sol, idx, CroSecs_in)}
    else:
        raise ValueError(f"Unsupported objective: {objective}")

def analyse_best_solution(solution, objective, CroSecs_in=None):
    """Analyze the best solution with fresh statistics."""
    sequence = [all_elements[int(i)] for i in solution]
    
    global cached_with_early_stop_fea_calls, cached_no_early_stop_fea_calls
    
    # Save current values
    saved_with_early_stop = cached_with_early_stop_fea_calls
    saved_no_early_stop = cached_no_early_stop_fea_calls
    
    # Reset counters for this analysis
    cached_with_early_stop_fea_calls = 0
    cached_no_early_stop_fea_calls = 0
    
    # Clear cache
    cached_results.clear()
    
    # Analyze best solution with early stopping disabled
    result = evaluate_sequence(Model_in, sequence, objective, CroSecs_in, enable_early_stopping=False)
    
    # Get statistics for this solution
    best_with_early_stop = cached_with_early_stop_fea_calls
    best_no_early_stop = cached_no_early_stop_fea_calls
    best_theoretical = len(sequence)  # Theoretical calls for a single sequence
    
    # Restore counters
    cached_with_early_stop_fea_calls = saved_with_early_stop
    cached_no_early_stop_fea_calls = saved_no_early_stop
    
    return result, best_theoretical, best_with_early_stop, best_no_early_stop

# Main optimization
if 'activate' in globals() and activate and 'Model_in' in globals() and Model_in:
    all_elements = [elem.ind for elem in Model_in.elems]
    num_elements = len(all_elements)
    fitness_history = []
    current_best_fitness = float('-inf')
    
    # GA 参数
    ga_params = get_ga_config(objective, CroSecs_in)
    ga_instance = pygad.GA(**ga_params)
    
    # 重置统计变量
    cached_no_early_stop_fea_calls = 0
    cached_with_early_stop_fea_calls = 0
    sequences_evaluated = 0
    
    try:
        initialize_with_feasible_population(ga_instance, Model_in)
        print(f"Starting GA run for {objective} optimization with heuristic initial population and stress scaling factor: 1e3...")
        ga_instance.run()
        
        solution, fitness, _ = ga_instance.best_solution()
        opt_seq = [all_elements[int(i)] for i in solution]
        
        # 计算理论调用次数 - 使用实际完成的代数而非预设值
        theoretical_fea_calls = ga_instance.generations_completed * ga_instance.sol_per_pop * num_elements
        
        # Analyze best solution
        result_value, best_theoretical, best_early_stop, best_no_early_stop = analyse_best_solution(
            solution, objective, CroSecs_in
        )
        
        print("\nOptimisation Results:")
        print(f"Optimised Sequence: {opt_seq}")
        print(f"Max {'Displacement' if objective == 'displacement' else 'Stress'}: {result_value}")
        print(f"Generations Completed: {ga_instance.generations_completed}")
        print(f"Total Sequences Evaluated: {sequences_evaluated}")
        
        print("\nFEA Call Statistics:")
        print(f"Theoretical FEA calls: {theoretical_fea_calls}")
        print(f"FEA calls with cache (no early stop): {cached_no_early_stop_fea_calls}")
        print(f"FEA calls with cache + early stop: {cached_with_early_stop_fea_calls}")
        
        # Efficiency metrics
        if theoretical_fea_calls > 0:
            cache_efficiency = (1 - cached_no_early_stop_fea_calls/theoretical_fea_calls) * 100
            print(f"Cache Efficiency: {cache_efficiency:.2f}% reduction")
        if cached_no_early_stop_fea_calls > 0:
            early_stop_efficiency = (1 - cached_with_early_stop_fea_calls/cached_no_early_stop_fea_calls) * 100
            print(f"Early Stopping Efficiency: {early_stop_efficiency:.2f}% additional reduction")
        if theoretical_fea_calls > 0:
            total_efficiency = (1 - cached_with_early_stop_fea_calls/theoretical_fea_calls) * 100
            print(f"Total Efficiency: {total_efficiency:.2f}% total reduction")
        
        # Best solution stats
        print("\nBest Solution FEA Call Analysis:")
        print(f"Theoretical FEA calls for best sequence: {best_theoretical}")
        print(f"FEA calls with cache (no early stop): {best_no_early_stop}")
        print(f"FEA calls with cache + early stop: {best_early_stop}")
        
        if best_theoretical > 0:
            best_cache_efficiency = (1 - best_no_early_stop/best_theoretical) * 100
            print(f"Cache Efficiency on best solution: {best_cache_efficiency:.2f}%")
        if best_no_early_stop > 0:
            best_early_stop_efficiency = (1 - best_early_stop/best_no_early_stop) * 100
            print(f"Early Stopping Efficiency on best solution: {best_early_stop_efficiency:.2f}%")
        if best_theoretical > 0:
            best_total_efficiency = (1 - best_early_stop/best_theoretical) * 100
            print(f"Total Efficiency on best solution: {best_total_efficiency:.2f}%")
        
        # Cache statistics
        total_evaluations = cache_hits + cache_misses
        cache_hit_rate = cache_hits / total_evaluations * 100 if total_evaluations > 0 else 0
        print(f"\nCache Access Statistics:")
        print(f"Cache Size: {len(cached_results)}")
        print(f"Cache Hits: {cache_hits}")
        print(f"Cache Misses: {cache_misses}")
        print(f"Cache Hit Rate: {cache_hit_rate:.2f}%")
        
    except Exception as e:
        print(f"GA execution failed: {e}")
        raise
    finally:
        cached_results.clear()
        print("Cache cleared. Current cache size:", len(cached_results))
else:
    print("GA not activated or Model_in not defined.")
# ---------- end python_3_script_7 ----------
beam_view_karamba3d = BeamView(Model=model_view_karamba3d.Model)  # -> Model, MeshesOfRenderedBeams, DeformedBeamAxes, LegendColours, LegendTags
quick_graph_3 = QuickGraph(python_3_script_4.fitness_history, SortOrder=0)
python_3_script_8 = Python3Script(activate=activate_7, Model_in=assemble_model_karamba3d.Model, objective=objective_5, CroSecs_in=cross_section_karamba3d)  # -> out, Model_out, flatten(opt_seq), flatten(fitness_history)
# ---------- python_3_script_8: Python ----------
import math
import random
from collections import defaultdict
import numpy as np

# Karamba imports
import Karamba.Models
import Karamba.Elements
import Karamba.Results
from System.Collections.Generic import List
from System import String
from Karamba.Algorithms import Analyze
from Karamba.Results import BeamResultantForces, NodeDisplacements

# Global variables
cached_results = defaultdict(float)
cache_hits = 0
cache_misses = 0

def check_sequence_feasibility(model, sequence):
    """Check if a construction sequence is feasible."""
    try:
        element_from_id = {e.ind: tuple(e.node_inds) for e in model.elems}
        ground_nodes = {s.node_ind for s in model.supports}
        active_nodes, active_elements = set(ground_nodes), set()
        
        for elem in sequence:
            node1, node2 = element_from_id[elem]
            if node1 not in active_nodes and node2 not in active_nodes:
                return False
            active_elements.add(elem)
            active_nodes.add(node1)
            active_nodes.add(node2)
        return True
    except Exception as e:
        print(f"Feasibility check error: {e}")
        return False

def evaluate_sequence(model, sequence, CroSecs_in=None, displacement_threshold=150.0, stress_threshold=150.0):
    """Evaluate a construction sequence against displacement and stress thresholds."""
    global cache_hits, cache_misses
    
    if not check_sequence_feasibility(model, sequence):
        return False, float("inf"), float("inf")
    
    try:
        fea_model = model.Clone()
        fea_model.cloneElements()
        load_cases = ["LC0"]
        max_displacement = 0.0
        max_stress = 0.0
        stress_scale = 1e3  # Scaling factor for stress
        
        # Evaluate displacement
        disps = []
        active_nodes = set()
        element_node_map = {e.ind: set(e.node_inds) for e in fea_model.elems}
        
        for i, elem_ind in enumerate(sequence):
            active_nodes.update(element_node_map[elem_ind])
            sub_seq = tuple(sequence[:i + 1])
            disp_key = (sub_seq, "displacement")
            
            if disp_key in cached_results:
                cache_hits += 1
                current_disp = cached_results[disp_key]
            else:
                cache_misses += 1
                for ele in fea_model.elems:
                    ele.set_is_active(fea_model, ele.ind in sub_seq)
                
                _, _, _, out_model, _ = Analyze.solve(fea_model, load_cases)
                node_indices = List[int](active_nodes)
                trans, _, _, _, _ = NodeDisplacements.solve(out_model, load_cases[0], node_indices)
                
                max_disp = max(math.sqrt(t.X**2 + t.Y**2 + t.Z**2) for nt in trans for t in nt)
                current_disp = max_disp * 1000  # Convert to mm
                cached_results[disp_key] = current_disp
            
            disps.append(current_disp)
            max_displacement = max(disps)
            if max_displacement > displacement_threshold:
                return False, max_displacement, max_stress
        
        # Evaluate stress if cross-section is provided
        if CroSecs_in is not None and hasattr(CroSecs_in, 'A') and hasattr(CroSecs_in, 'Wely_z_pos'):
            stresses = []
            for i, elem_ind in enumerate(sequence):
                sub_seq = tuple(sequence[:i + 1])
                stress_key = (sub_seq, "stress", stress_scale)
                
                if stress_key in cached_results:
                    cache_hits += 1
                    current_stress = cached_results[stress_key]
                else:
                    cache_misses += 1
                    for ele in fea_model.elems:
                        ele.set_is_active(fea_model, ele.ind in sub_seq)
                    
                    _, _, _, out_model, _ = Analyze.solve(fea_model, load_cases)
                    max_stress_step = 0.0
                    
                    for elem_ind in sub_seq:
                        beam = out_model.elems[elem_ind]
                        if not isinstance(beam, Karamba.Elements.ModelBeam):
                            continue
                        
                        elem_id = List[String]([str(elem_ind)])
                        N, V, M = BeamResultantForces.solve(out_model, elem_id, load_cases[0], 1, 1)
                        axial_stress = abs(N[0][0]) / CroSecs_in.A
                        bending_stress = abs(M[0][0]) / CroSecs_in.Wely_z_pos
                        total_stress = (axial_stress + bending_stress) / stress_scale  # Convert to MPa
                        max_stress_step = max(max_stress_step, total_stress)
                    
                    current_stress = max_stress_step
                    cached_results[stress_key] = current_stress
                
                stresses.append(current_stress)
                max_stress = max(stresses)
                if max_stress > stress_threshold:
                    return False, max_displacement, max_stress
        
        return True, max_displacement, max_stress
    
    except Exception as e:
        print(f"Evaluation failed for sequence {sequence}: {e}")
        return False, float("inf"), float("inf")

def compute_element_distances(model):
    """Compute minimum distance from each element to any support node."""
    element_from_id = {e.ind: tuple(e.node_inds) for e in model.elems}
    ground_nodes = {s.node_ind for s in model.supports}
    distances = {}
    
    for elem_id, (node1, node2) in element_from_id.items():
        pos1, pos2 = model.nodes[node1].pos, model.nodes[node2].pos
        min_dist = float('inf')
        for ground_node in ground_nodes:
            ground_pos = model.nodes[ground_node].pos
            dist1 = math.sqrt(sum((getattr(pos1, dim) - getattr(ground_pos, dim))**2 for dim in ('X', 'Y', 'Z')))
            dist2 = math.sqrt(sum((getattr(pos2, dim) - getattr(ground_pos, dim))**2 for dim in ('X', 'Y', 'Z')))
            min_dist = min(min_dist, dist1, dist2)
        distances[elem_id] = min_dist
    
    return distances

def greedy_construction_sequence(model, CroSecs_in=None, displacement_threshold=25.0, stress_threshold=355.0):
    """Greedily construct a sequence ensuring displacement < 30mm and stress < 150MPa."""
    try:
        element_from_id = {e.ind: tuple(e.node_inds) for e in model.elems}
        ground_nodes = {s.node_ind for s in model.supports}
        all_elements = [e.ind for e in model.elems]
        active_nodes = set(ground_nodes)
        sequence = []
        remaining_elements = set(all_elements)
        max_displacement_global = 0.0
        max_stress_global = 0.0
        step_history = []
        
        element_distances = compute_element_distances(model)
        
        while remaining_elements:
            feasible_elements = [e for e in remaining_elements if any(n in active_nodes for n in element_from_id[e])]
            if not feasible_elements:
                print("Warning: No feasible element found to continue the sequence!")
                return None, float("inf"), float("inf"), []
            
            # Try elements in random order to avoid bias
            random.shuffle(feasible_elements)
            selected_elem = None
            
            for elem in feasible_elements:
                temp_seq = sequence + [elem]
                is_feasible, current_displacement, current_stress = evaluate_sequence(
                    model, temp_seq, CroSecs_in, displacement_threshold, stress_threshold)
                
                if is_feasible:
                    selected_elem = elem
                    max_displacement_global = max(max_displacement_global, current_displacement)
                    max_stress_global = max(max_stress_global, current_stress)
                    break
            
            if selected_elem is None:
                print("Warning: No element meets displacement or stress thresholds!")
                return None, float("inf"), float("inf"), []
            
            sequence.append(selected_elem)
            active_nodes.update(element_from_id[selected_elem])
            remaining_elements.remove(selected_elem)
            step_history.append((selected_elem, max_displacement_global, max_stress_global))
            
            if len(sequence) % max(1, len(all_elements) // 10) == 0:
                print(f"Step {len(sequence)}: Added element {selected_elem}, "
                      f"Displacement: {max_displacement_global:.6f} mm, Stress: {max_stress_global:.6f} MPa")
        
        return sequence, max_displacement_global, max_stress_global, step_history
    except Exception as e:
        print(f"Greedy construction failed: {e}")
        return None, float("inf"), float("inf"), []

# Main optimization
if 'activate' in globals() and activate and 'Model_in' in globals() and Model_in:
    all_elements = [elem.ind for elem in Model_in.elems]
    
    # Initialize global variables
    cached_results.clear()
    cache_hits = 0
    cache_misses = 0
    
    try:
        print("Starting greedy optimization for feasible sequence with displacement < 150mm and stress < 150MPa...")
        opt_seq, max_displacement, max_stress, history = greedy_construction_sequence(
            Model_in, CroSecs_in=CroSecs_in)
        
        if opt_seq is None:
            print("Failed to construct a feasible sequence.")
        else:
            print("\nOptimization Results:")
            print(f"Feasible Sequence: {opt_seq}")
            print(f"Number of elements: {len(opt_seq)}")
            print(f"Maximum displacement during assembly: {max_displacement:.6f} mm")
            print(f"Maximum stress during assembly: {max_stress:.6f} MPa")
            
            print("\nAssembly History:")
            for step, (elem, disp, stress) in enumerate(history):
                print(f"Step {step+1}: Element {elem}, Displacement: {disp:.6f} mm, Stress: {stress:.6f} MPa")
            
            total_evaluations = cache_hits + cache_misses
            cache_hit_rate = cache_hits / total_evaluations * 100 if total_evaluations > 0 else 0
            print(f"\nCache Statistics:")
            print(f"Sequence Evaluations: {total_evaluations}")
            print(f"Cache Hits: {cache_hits}")
            print(f"Cache Misses: {cache_misses}")
            print(f"Cache Hit Rate: {cache_hit_rate:.2f}%")
        
    except Exception as e:
        print(f"Greedy optimization failed: {e}")
        raise
    finally:
        cached_results.clear()
        print("Cache cleared. Current cache size:", len(cached_results))
else:
    print("Greedy optimization not activated or Model_in not defined.")
# ---------- end python_3_script_8 ----------
python_3_script_9 = Python3Script(activate=activate_8, Model_in=assemble_model_karamba3d.Model, objective=objective_6, CroSecs_in=cross_section_karamba3d)  # -> out, Model_out, flatten(opt_seq), flatten(fitness_history)
# ---------- python_3_script_9: Python ----------
import math
import random
from collections import defaultdict
import numpy as np

# Karamba imports
import Karamba.Models
import Karamba.Elements
import Karamba.Results
from System.Collections.Generic import List
from System import String
from Karamba.Algorithms import Analyze
from Karamba.Results import BeamResultantForces, NodeDisplacements

# Global variables
cached_results = defaultdict(float)
cache_hits = 0
cache_misses = 0
current_best_fitness = float('-inf')

def check_sequence_feasibility(model, sequence):
    """Check if a construction sequence is feasible."""
    try:
        element_from_id = {e.ind: tuple(e.node_inds) for e in model.elems}
        ground_nodes = {s.node_ind for s in model.supports}
        active_nodes, active_elements = set(ground_nodes), set()
        
        for elem in sequence:
            node1, node2 = element_from_id[elem]
            if node1 not in active_nodes and node2 not in active_nodes:
                return False
            active_elements.add(elem)
            active_nodes.add(node1)
            active_nodes.add(node2)
        return True
    except Exception as e:
        print(f"Feasibility check error: {e}")
        return False

def evaluate_sequence(model, sequence, objective="displacement", CroSecs_in=None, enable_early_stopping=True):
    """Evaluate a construction sequence with caching and optional early termination."""
    global cache_hits, cache_misses, current_best_fitness
    
    if not check_sequence_feasibility(model, sequence):
        return float("inf")
    
    try:
        fea_model = model.Clone()
        fea_model.cloneElements()
        load_cases = ["LC0"]
        max_value = 0.0
        stress_scale = 1e3  # Store scaling factor for stress
        
        if objective == "displacement":
            disps = []
            active_nodes = set()
            element_node_map = {e.ind: set(e.node_inds) for e in fea_model.elems}
            
            for i, elem_ind in enumerate(sequence):
                active_nodes.update(element_node_map[elem_ind])
                sub_seq = tuple(sequence[:i + 1])
                sub_key = (sub_seq, objective)
                
                if sub_key in cached_results:
                    cache_hits += 1
                    current_disp = cached_results[sub_key]
                else:
                    cache_misses += 1
                    for ele in fea_model.elems:
                        ele.set_is_active(fea_model, ele.ind in sub_seq)
                    
                    _, _, _, out_model, _ = Analyze.solve(fea_model, load_cases)
                    node_indices = List[int](active_nodes)
                    trans, _, _, _, _ = NodeDisplacements.solve(out_model, load_cases[0], node_indices)
                    
                    max_disp = max(math.sqrt(t.X**2 + t.Y**2 + t.Z**2) for nt in trans for t in nt)
                    current_disp = max_disp * 1000  # Convert to mm
                    cached_results[sub_key] = current_disp
                
                disps.append(current_disp)
                max_value = max(disps)
                
                if enable_early_stopping and -max_value < current_best_fitness:
                    return max_value
                    
            return max_value
            
        elif objective == "stress":
            if CroSecs_in is None or not hasattr(CroSecs_in, 'A') or not hasattr(CroSecs_in, 'Wely_z_pos'):
                raise ValueError("Valid Cross-section (CroSecs_in) must be provided for stress objective!")
                
            stresses = []
            for i, elem_ind in enumerate(sequence):
                sub_seq = tuple(sequence[:i + 1])
                sub_key = (sub_seq, objective, stress_scale)  # Include scale in cache key
                
                if sub_key in cached_results:
                    cache_hits += 1
                    current_stress = cached_results[sub_key]
                else:
                    cache_misses += 1
                    for ele in fea_model.elems:
                        ele.set_is_active(fea_model, ele.ind in sub_seq)
                    
                    _, _, _, out_model, _ = Analyze.solve(fea_model, load_cases)
                    max_stress = 0.0
                    
                    for elem_ind in sub_seq:
                        beam = out_model.elems[elem_ind]
                        if not isinstance(beam, Karamba.Elements.ModelBeam):
                            continue
                        
                        elem_id = List[String]([str(elem_ind)])
                        N, V, M = BeamResultantForces.solve(out_model, elem_id, load_cases[0], 1, 1)
                        axial_stress = abs(N[0][0]) / CroSecs_in.A
                        bending_stress = abs(M[0][0]) / CroSecs_in.Wely_z_pos
                        total_stress = (axial_stress + bending_stress) / stress_scale  # Convert to MPa
                        max_stress = max(max_stress, total_stress)
                    
                    current_stress = max_stress
                    cached_results[sub_key] = current_stress
                
                stresses.append(current_stress)
                max_value = max(stresses)
                
                if enable_early_stopping and -max_value < current_best_fitness:
                    return max_value
                    
            return max_value
        
        raise ValueError(f"Unsupported objective: {objective}")
    except Exception as e:
        print(f"Evaluation failed for sequence {sequence}: {e}")
        return float("inf")

def compute_element_distances(model):
    """Compute minimum distance from each element to any support node."""
    element_from_id = {e.ind: tuple(e.node_inds) for e in model.elems}
    ground_nodes = {s.node_ind for s in model.supports}
    distances = {}
    
    for elem_id, (node1, node2) in element_from_id.items():
        pos1, pos2 = model.nodes[node1].pos, model.nodes[node2].pos
        min_dist = float('inf')
        for ground_node in ground_nodes:
            ground_pos = model.nodes[ground_node].pos
            dist1 = math.sqrt(sum((getattr(pos1, dim) - getattr(ground_pos, dim))**2 for dim in ('X', 'Y', 'Z')))
            dist2 = math.sqrt(sum((getattr(pos2, dim) - getattr(ground_pos, dim))**2 for dim in ('X', 'Y', 'Z')))
            min_dist = min(min_dist, dist1, dist2)
        distances[elem_id] = min_dist
    
    return distances

def greedy_construction_sequence(model, objective="displacement", CroSecs_in=None):
    """Greedily construct a sequence minimizing maximum objective during assembly."""
    try:
        element_from_id = {e.ind: tuple(e.node_inds) for e in model.elems}
        ground_nodes = {s.node_ind for s in model.supports}
        all_elements = [e.ind for e in model.elems]
        active_nodes = set(ground_nodes)
        sequence = []
        remaining_elements = set(all_elements)
        max_value_global = 0.0
        step_history = []
        
        element_distances = compute_element_distances(model)
        
        while remaining_elements:
            best_elem = None
            best_value = float('inf')
            
            feasible_elements = [e for e in remaining_elements if any(n in active_nodes for n in element_from_id[e])]
            if not feasible_elements:
                print("Warning: No feasible element found to continue the sequence!")
                return None, float("inf"), []
            
            for elem in feasible_elements:
                temp_seq = sequence + [elem]
                current_value = evaluate_sequence(model, temp_seq, objective, CroSecs_in, enable_early_stopping=False)
                if current_value < best_value:
                    best_value = current_value
                    best_elem = elem
                elif current_value == best_value and best_elem is not None:
                    if element_distances[elem] < element_distances[best_elem]:
                        best_elem = elem
            
            if best_elem is None:
                print("Warning: No feasible element selected!")
                return None, float("inf"), []
            
            sequence.append(best_elem)
            active_nodes.update(element_from_id[best_elem])
            remaining_elements.remove(best_elem)
            step_history.append(best_value)
            max_value_global = max(max_value_global, best_value)
            
            if len(sequence) % max(1, len(all_elements) // 10) == 0:
                print(f"Step {len(sequence)}: Added element {best_elem}, {objective}: {best_value:.6f}, Global max: {max_value_global:.6f}")
        
        return sequence, max_value_global, step_history
    except Exception as e:
        print(f"Greedy construction failed: {e}")
        return None, float("inf"), []

# Main optimization
if 'activate' in globals() and activate and 'Model_in' in globals() and Model_in:
    all_elements = [elem.ind for elem in Model_in.elems]
    
    # Initialize global variables
    cached_results.clear()
    cache_hits = 0
    cache_misses = 0
    current_best_fitness = float('-inf')
    
    try:
        print(f"Starting greedy optimization for {objective} minimization with stress scaling factor: 1e3...")
        opt_seq, global_max, history = greedy_construction_sequence(
            Model_in, objective=objective, CroSecs_in=CroSecs_in)
        
        if opt_seq is None:
            print("Failed to construct a feasible sequence.")
        else:
            print("\nOptimization Results:")
            print(f"Optimized Sequence: {opt_seq}")
            print(f"Number of elements: {len(opt_seq)}")
            print(f"Global max {objective} during assembly: {global_max:.6f}")
            print(f"Final {objective}: {history[-1]:.6f}")
            
            print("\nAssembly History:")
            for step, (elem, val) in enumerate(zip(opt_seq, history)):
                print(f"Step {step+1}: Element {elem}, {objective}: {val:.6f}")
            
            total_evaluations = cache_hits + cache_misses
            cache_hit_rate = cache_hits / total_evaluations * 100 if total_evaluations > 0 else 0
            print(f"\nCache Statistics:")
            print(f"Sequence Evaluations: {total_evaluations}")
            print(f"Cache Hits: {cache_hits}")
            print(f"Cache Misses: {cache_misses}")
            print(f"Cache Hit Rate: {cache_hit_rate:.2f}%")
        
    except Exception as e:
        print(f"Greedy optimization failed: {e}")
        raise
    finally:
        cached_results.clear()
        print("Cache cleared. Current cache size:", len(cached_results))
else:
    print("Greedy optimization not activated or Model_in not defined.")
# ---------- end python_3_script_9 ----------
quick_graph_4 = QuickGraph(python_3_script_5.fitness_history, SortOrder=0)
panel_9 = Panel(python_3_script_4.out)
quick_graph_5 = QuickGraph(python_3_script_6.fitness_history, SortOrder=0)
activate_9 = BooleanToggle(False)
integer = Integer(remap_numbers.Mapped)
panel_10 = Panel(integer)
panel_11 = Panel(python_3_script_5.out)
panel_12 = Panel(python_3_script_6.out)
python_3_script_10 = Python3Script(Model_in=assemble_model_karamba3d.Model, sequence=min_stress, CroSecs_in=cross_section_karamba3d)  # -> out
# ---------- python_3_script_10: Python ----------
import Karamba.Models
import Karamba.CrossSections
import Karamba.Elements
import Karamba.Results
from System.Collections.Generic import List
from System import String
import ast
from Karamba.Algorithms import Analyze
from Karamba.Results import BeamResultantForces, NodeDisplacements
import math

# Assume inputs are defined
# Model_in: Input model
# sequence: Element activation sequence, possibly as a string input, e.g., "[0, 1, 2, ..., 48]"
# CroSecs_in: Cross-section information

# Clone the model
model = Model_in.Clone()
model.cloneElements()
load_cases = ["LC0"]

# Initialize result lists
displacements = []
stresses = []

# If sequence is a string, convert it to a list first
if isinstance(sequence, str):
    sequence = ast.literal_eval(sequence)  # Safely convert string list to actual list
sequence = [int(x) for x in sequence]  # Ensure all elements are integers

# Check if CroSecs_in is valid for stress calculation
if CroSecs_in is None or not hasattr(CroSecs_in, 'A') or not hasattr(CroSecs_in, 'Wely_z_pos'):
    raise ValueError("Valid Cross-section (CroSecs_in) must be provided for stress calculation!")

# Gradually activate elements and compute
for i in range(len(sequence)):
    # Current subsequence
    active_ids = sequence[:i + 1]
    
    # Set element activation status
    for ele in model.elems:
        ele_ind = int(ele.ind)  # Ensure ele.ind is an integer
        ele.set_is_active(model, ele_ind in active_ids)
    
    # Compute displacement (convert from meters to millimeters)
    _, _, _, out_model, _ = Analyze.solve(model, load_cases)

    # Get unique nodes from active elements
    active_nodes = set()
    for elem_ind in active_ids:
        elem = out_model.elems[elem_ind]
        if hasattr(elem, 'node_inds'):
            for node_ind in elem.node_inds:
                active_nodes.add(node_ind)

    max_disp = 0.0
    if active_nodes:
        node_indices = List[int](active_nodes)  # Only include currently active nodes
        trans, _, _, _, _ = NodeDisplacements.solve(out_model, load_cases[0], node_indices)
        
        # Find maximum displacement magnitude among all active nodes
        for node_translations in trans:
            for translation in node_translations:
                disp_magnitude = math.sqrt(translation.X**2 + translation.Y**2 + translation.Z**2)
                if disp_magnitude > max_disp:
                    max_disp = disp_magnitude
    
    # Convert from meters to millimeters
    current_disp = max_disp * 1000
    displacements.append(current_disp)
    
    # Compute stress (in MPa)
    current_max_stress = 0.0
    for elem_ind in active_ids:
        beam = out_model.elems[elem_ind]
        if not isinstance(beam, Karamba.Elements.ModelBeam):
            continue
            
        elem_id = List[String]([str(elem_ind)])
        N, V, M = BeamResultantForces.solve(out_model, elem_id, load_cases[0], 1, 1)
        
        # Calculate axial and bending stresses
        axial_stress = abs(N[0][0]) / CroSecs_in.A  # N/mm² (MPa)
        bending_stress = abs(M[0][0]) / CroSecs_in.Wely_z_pos  # N/mm² (MPa)
        total_stress = (axial_stress + bending_stress) / 1e3  # Convert from kPa to MPa
        
        current_max_stress = max(current_max_stress, total_stress)
    
    stresses.append(current_max_stress)

# Output results with 4 decimal places
print("Displacement sequence (mm):")
print([f"{d:.4f}" for d in displacements])
print("\nStress sequence (MPa):")
print([f"{s:.4f}" for s in stresses])
# ---------- end python_3_script_10 ----------
greedy_algorithm_disp = Panel("[12, 24, 36, 11, 43, 23, 25, 0, 37, 13, 1, 26, 38, 14, 10, 35, 44, 22, 2, 27, 9, 39, 34, 45, 15, 3, 21, 8, 28, 40, 33, 46, 4, 16, 7, 20, 32, 47, 29, 41, 5, 17, 6, 19, 31, 48, 30, 42, 18]")
greedy_algorithm_stress = Panel("[12, 24, 36, 25, 43, 11, 37, 0, 23, 13, 35, 44, 10, 26, 38, 1, 22, 14, 27, 39, 2, 34, 45, 9, 15, 21, 28, 40, 3, 33, 46, 8, 16, 20, 32, 47, 7, 29, 41, 4, 17, 19, 31, 48, 5, 6, 30, 42, 18]")
panel_13 = Panel(python_3_script_7.out)
greedy_algorithm = Panel(python_3_script_8.out)
legend = Legend(Colour=beam_view_karamba3d.LegendColours, Tags=beam_view_karamba3d.LegendTags, LegendType=101)
python_3_script_11 = Python3Script(Model_in=assemble_model_karamba3d.Model, sequence=panel_8, elem_idx=integer)  # -> out, Model_out, isActive; inputs elem_idx: Int32
# ---------- python_3_script_11: Python ----------
import Karamba.Models
import Karamba.CrossSections
import Karamba.Elements
import Karamba.Results
import KarambaCommon
from Karamba.Elements.States.Selectors import StateElement1DSelectorIndex
from Karamba.Geometry import *
from System.Collections.Generic import List
from System import String
import ast
from Karamba.GHopper.Models import GH_Model

model = Model_in.Clone()
model.cloneElements()

elements = ast.literal_eval(sequence)
element_index = elements[: elem_idx + 1]

for ele in model.elems:
    ele.set_is_active(model, ele.ind in element_index)

elem_activity = [elem.IsActive for elem in model.elems]
isActive = elem_activity

Model_out = GH_Model(model)
# ---------- end python_3_script_11 ----------
python_3_script_12 = Python3Script(Model_in=assemble_model_karamba3d.Model, activate=activate_9)  # -> out
# ---------- python_3_script_12: Python ----------
import math
from itertools import permutations
import Karamba.Models
from System.Collections.Generic import List

def check_sequence_feasibility(model, sequence):
    """Check if a construction sequence is feasible."""
    try:
        element_from_id = {e.ind: tuple(e.node_inds) for e in model.elems}
        ground_nodes = {s.node_ind for s in model.supports}
        active_nodes, active_elements = set(ground_nodes), set()
        
        for elem in sequence:
            node1, node2 = element_from_id[elem]
            if node1 not in active_nodes and node2 not in active_nodes:
                return False
            active_elements.add(elem)
            active_nodes.add(node1)
            active_nodes.add(node2)
        return True
    except Exception as e:
        print(f"Feasibility check error: {e}")
        return False

def count_feasible_sequences(model):
    """Calculate the exact number of feasible sequences and total sequences."""
    all_elements = [elem.ind for elem in model.elems]
    num_elements = len(all_elements)
    
    # Total number of possible sequences is n!
    total_sequences = math.factorial(num_elements)
    
    # Enumerate all permutations to count feasible sequences
    feasible_count = 0
    for seq in permutations(all_elements):
        if check_sequence_feasibility(model, seq):
            feasible_count += 1
            
    return total_sequences, feasible_count

# Main execution
if 'activate' in globals() and activate and 'Model_in' in globals() and Model_in:
    try:
        total, feasible = count_feasible_sequences(Model_in)
        print(f"Total number of possible sequences: {total}")
        print(f"Number of feasible sequences: {feasible}")
        if len(Model_in.elems) > 10:
            print("(Warning: Exact enumeration may be slow for large models with >10 elements)")
    except Exception as e:
        print(f"Error in counting sequences: {e}")
else:
    print("Model_in not defined or activate flag not set.")
# ---------- end python_3_script_12 ----------
greedy_algorithm_2 = Panel(python_3_script_9.out)
analyse_karamba3d_2 = Analyse(Model=python_3_script_11.Model_out)  # -> AnalysedModel, MaximumDisplacement_cm, ResultingForce_kN, ChangeOfElasticEnergy_kNm
list_item = ListItem(List=panel_9, Index=Slider(11, range=0..50), Wrap=True)
list_item_2 = ListItem(List=panel_11, Index=Slider(11, range=0..50), Wrap=True)
list_item_3 = ListItem(List=panel_12, Index=Slider(6, range=0..50), Wrap=True)
list_item_4 = ListItem(List=panel_13, Index=Slider(10, range=0..50), Wrap=True)
list_item_5 = ListItem(List=greedy_algorithm, Index=Slider(15, range=0..50), Wrap=True)
list_item_6 = ListItem(List=greedy_algorithm_2, Index=Slider(15, range=0..50), Wrap=True)
model_view_karamba3d_2 = ModelView(Model=analyse_karamba3d_2.AnalysedModel)  # -> Model, DeformedMesh, DeformedAxes, DeformedModel, MaximumDeformation
panel_14 = Panel(list_item)
panel_15 = Panel(list_item_2)
panel_16 = Panel(list_item_3)
panel_17 = Panel(list_item_4)
panel_18 = Panel(list_item_5)
panel_19 = Panel(list_item_6)
beam_view_karamba3d_2 = BeamView(Model=model_view_karamba3d_2.Model)  # -> Model, MeshesOfRenderedBeams, DeformedBeamAxes, LegendColours, LegendTags
legend_2 = Legend(Colour=beam_view_karamba3d_2.LegendColours, Tags=beam_view_karamba3d_2.LegendTags, LegendType=101)
disassemble_model_karamba3d = Disassemble(Model=model_view_karamba3d_2.Model)  # -> Model, Point, Beam, Shell, Support, Load, Line, Mesh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
remove_duplicate_lines_karamba3d_2 = RDLines(Line=disassemble_model_karamba3d.Line, LimitDistance="0.00001")  # -> OutLine, Info, Indexes
length = Length(Curve=remove_duplicate_lines_karamba3d_2.OutLine)
larger_than = LargerThan(FirstNumber=length, SecondNumber="0.001")  # -> LargerThan, OrEqualTo
deconstruct = Deconstruct(Point=disassemble_model_karamba3d.Point)  # -> XComponent, YComponent, ZComponent
deconstruct_2 = Deconstruct(Point=point_2)  # -> XComponent, YComponent, ZComponent
cull_pattern_2 = CullPattern(List=remove_duplicate_lines_karamba3d_2.OutLine, CullPattern=larger_than.LargerThan)
end_points = EndPoints(Curve=cull_pattern_2)  # -> Start, End
deconstruct_3 = Deconstruct(Point=end_points.Start)  # -> XComponent, YComponent, ZComponent
deconstruct_4 = Deconstruct(Point=end_points.End)  # -> XComponent, YComponent, ZComponent
save = Button()
python_3_script_13 = Python3Script(
    save=save,
    node_x=deconstruct.XComponent,
    node_y=deconstruct.ZComponent,
    start_node_x=deconstruct_3.XComponent,
    start_node_y=deconstruct_3.ZComponent,
    end_node_x=deconstruct_4.XComponent,
    end_node_y=deconstruct_4.ZComponent,
    support_node_x=deconstruct_2.XComponent,
    support_node_y=deconstruct_2.ZComponent)  # -> out, simplify(truss_info); inputs node_x: list, node_y: list, start_node_x: list, start_node_y: list, end_node_x: list, end_node_y: list, support_node_x: list, support_node_y: list
# ---------- python_3_script_13: Python ----------
import json
import Grasshopper
import Rhino
import os

if save:
    # Process node coordinates with explicit structure
    nodes = []
    for i, (x, y) in enumerate(zip(node_x, node_y)):
        # Check if this node is a support node
        is_support_node = any(
            (abs(x - sx) < 1e-6 and abs(y - sy) < 1e-6) 
            for sx, sy in zip(support_node_x, support_node_y)
        )
        nodes.append({
            "id": i,
            "x": x,
            "y": y,
            "is_support": is_support_node
        })

    # Process bar connections with numbering
    bars = []
    node_coords = [(n["x"], n["y"]) for n in nodes]  # Temporary list for coordinate lookup
    for i, (start_x, start_y, end_x, end_y) in enumerate(zip(start_node_x, start_node_y, end_node_x, end_node_y)):
        start_idx = min(enumerate(node_coords), key=lambda n: (n[1][0]-start_x)**2 + (n[1][1]-start_y)**2)[0]
        end_idx = min(enumerate(node_coords), key=lambda n: (n[1][0]-end_x)**2 + (n[1][1]-end_y)**2)[0]
        bars.append({
            "id": i,          # Add bar ID based on current order
            "start": start_idx,
            "end": end_idx
        })

    # Create the structure for JSON
    truss_info = {
        "nodes": nodes,
        "bars": bars
    }

    file_path = Grasshopper.Instances.ActiveCanvas.Document.FilePath
    folder_path = os.path.dirname(file_path)

    json_path = os.path.join(folder_path, "truss_info_update.json")
    with open(json_path, 'w') as json_file:
        json.dump(truss_info, json_file, indent=4)
# ---------- end python_3_script_13 ----------
